# Dynamo graph BatchPrintToPDF_DWG.dyn (Dynamo 1.3.4.6666)

# group: PRINT TO PDF STEP 1. SET BOOLEAN FROM FALSE TO TRUE
# note: PRINTING TO PDF & DWG
# VER 1.2 - 21.12.2020
# note: ISSUES RESOLVED: CORRECTLY RENAMES SHEETS WITH   /   SYMBOL
view_sets = ViewSetUi("Set 1")
get_views_from_view_set = Custom[Get Views from View Set](ViewSet=view_sets)  # This node will take a name of a view set and return views/sheet elements contained in it.
print_range = PrintRangeUi("Select")
boolean = BoolSelector(false)
code_block = CodeBlock { "PDF-XChange Lite"; }
print_settings = PrintSettingUi("A1 PLOT - COLOR")
file_path = Filename("..\..\Temp\PRINT TEST\randompdf.pdf")
print_pdf = BoolSelector(true)
print_pdf_2 = Custom[Print PDF](Views=get_views_from_view_set, PrintRange=print_range, CombinedFile=boolean, PrinterName=code_block, PrintSettings=print_settings, FilePath=file_path, RunIt=print_pdf)  # This node will allow you to initiate a printing routine in revit from a set of views/sheets, printer name, print settings and print range.

# group: RENAME PDFs, STEP 2. SET BOOLEAN FROM FALSE TO TRUE
directoryName = FilePath.DirectoryName(file_path)
code_block_2 = CodeBlock { "Sheet Name"; "Sheet Number"; "Current Revision"; "Project Sheet Code"; }
getParameterValueByName = Element.GetParameterValueByName(element=get_views_from_view_set, parameterName=code_block_2.out1)
string_from_object = FromObject(getParameterValueByName)
getParameterValueByName_2 = Element.GetParameterValueByName(element=get_views_from_view_set, parameterName=code_block_2.out3)
string_from_object_2 = FromObject(getParameterValueByName_2)
getParameterValueByName_3 = Element.GetParameterValueByName(element=get_views_from_view_set, parameterName=code_block_2.out2)
string_from_object_3 = FromObject(getParameterValueByName_3)
code_block_3 = CodeBlock(z=string_from_object_2, x=string_from_object, y=string_from_object_3) { z+x+"["+y+"].pdf"; }
rename_pdf = BoolSelector(false)
python_script = Python(IN[0]=directoryName, IN[1]=string_from_object, IN[2]=code_block_3, IN[3]=rename_pdf)
# ---------- python_script.python (51 lines) ----------
#Copyright(c) 2015, Konrad Sobon
# @arch_laboratory, http://archi-lab.net

import clr
clr.AddReference('ProtoGeometry')
from Autodesk.DesignScript.Geometry import *

# Import DocumentManager and TransactionManager
clr.AddReference("RevitServices")
import RevitServices
from RevitServices.Persistence import DocumentManager
from RevitServices.Transactions import TransactionManager

doc = DocumentManager.Instance.CurrentDBDocument
uiapp = DocumentManager.Instance.CurrentUIApplication
app = uiapp.Application

# Import RevitAPI
clr.AddReference("RevitAPI")
import Autodesk
from Autodesk.Revit.DB import *
from Autodesk.Revit import *
import System

import sys
pyt_path = r'C:\Program Files (x86)\IronPython 2.7\Lib'
sys.path.append(pyt_path)

import os
filePath = IN[0]
identifiers = IN[1]
newNames = IN[2]
RunIt = IN[3]
message = []

files = os.listdir(filePath)

if RunIt:
	for file in files:
		currentFileName = filePath + "\\" + file
		for i,j in zip(identifiers, newNames):
			newFileName = filePath + "\\" + j
			if i in file and currentFileName != newFileName:
				try:
					os.rename(currentFileName, newFileName)
				except:
					message = "Your intended file name is not a compatible file name. Make sure that you are not strings like..."
					pass
#docName = uiapp.ActiveUIDocument.Document.Title
#Assign your output to the OUT variable
OUT = files
# ----------------------------------------

# group: EXPORT TO DWG STEP 3. SET BOOLEAN TO TRUE
code_block_4 = CodeBlock(z=string_from_object_2, x=string_from_object, y=string_from_object_3) { z+x+"_DWG"+"["+y+"]"; }
export_dwg = BoolSelector(false)
code_block_5 = CodeBlock { "SMG_OPTIONS"; }
python_script_2 = Python(IN[0]=directoryName, IN[1]=get_views_from_view_set, IN[2]=code_block_4, IN[3]=export_dwg, IN[4]=code_block_5)
# ---------- python_script_2.python (81 lines) ----------
# Copyright(c) 2016, Konrad K Sobon
# @arch_laboratory, http://archi-lab.net

# Import Element wrapper extension methods
import clr
clr.AddReference("RevitNodes")
import Revit
clr.ImportExtensions(Revit.Elements)

# Import DocumentManager and TransactionManager
clr.AddReference("RevitServices")
import RevitServices
from RevitServices.Persistence import DocumentManager
doc = DocumentManager.Instance.CurrentDBDocument

# Import RevitAPI
clr.AddReference("RevitAPI")
import Autodesk
from Autodesk.Revit.DB import *

import System
from System.Collections.Generic import *

import sys
pyt_path = r'C:\Program Files (x86)\IronPython 2.7\Lib'
sys.path.append(pyt_path)

#The inputs to this node will be stored as a list in the IN variable.
dataEnteringNode = IN

def ProcessList(_func, _list):
    return map( lambda x: ProcessList(_func, x) if type(x)==list else _func(x), _list )

def ProcessParallelLists(_func, *lists):
	return map( lambda *xs: ProcessParallelLists(_func, *xs) if all(type(x) is list for x in xs) else _func(*xs), *lists )

def Unwrap(item):
	return UnwrapElement(item)

folderPath = IN[0]
exportOptions = IN[4]

if isinstance(IN[1], list):
	views = ProcessList(Unwrap, IN[1])
else:
	views = list(Unwrap(IN[1]))

if isinstance(IN[2], list):
	names = IN[2]
else:
	names = list(IN[2])

RunIt = IN[3]

def ExportDwg(name, view, folder = folderPath):
	options = DWGExportOptions()
	options = options.GetPredefinedOptions(doc, exportOptions)
	options.MergedViews = IN[3]
	views = List[ElementId]()
	views.Add(view.Id)
	result = doc.Export(folder, name, views, options)
	return result

if RunIt:
	try:
		errorReport = None
		# run export
		ProcessParallelLists(ExportDwg, names, views)
		
	except:
		# if error accurs anywhere in the process catch it
		import traceback
		errorReport = traceback.format_exc()
else:
	errorReport = "Please set the RunIt to True!"

#Assign your output to the OUT variable
if errorReport == None:
	OUT = 0
else:
	OUT = errorReport
# ----------------------------------------
