# Dynamo graph ChangeSheetNumber.dyn (Dynamo 1.3.4.6666)

categories = Categories("Sheets")
all_elements_of_category = ElementsOfCategory(categories)
code_block = CodeBlock { "Project Sheet Code"; }
parameterByName = Parameter.ParameterByName(element=all_elements_of_category, name=code_block)
value = Parameter.Value(parameterByName)
boolean = BoolSelector(false)
clean = List.Clean(list=value, preserveIndices=boolean)
code_block_2 = CodeBlock { "-G-"; "-1-"; "-2-"; "-R-"; }
endsWith = String.EndsWith(clean, code_block_2.out0)
filterByBoolMask = List.FilterByBoolMask(list=all_elements_of_category, mask=endsWith)
string = StringInput("Sheet Number")
string_2 = StringInput("Sheet Number")
parameterByName_2 = Parameter.ParameterByName(element=filterByBoolMask.in, name=string_2)
value_2 = Parameter.Value(parameterByName_2)
string_3 = StringInput("-L0")
add = value_2 + string_3
setParameterByName = Element.SetParameterByName(element=filterByBoolMask.in, parameterName=string, value=add)
string_4 = StringInput("Project Sheet Code")
string_5 = StringInput("SMG-RMB-")
setParameterByName_2 = Element.SetParameterByName(element=setParameterByName, parameterName=string_4, value=string_5)
endsWith_2 = String.EndsWith(clean, code_block_2.out1)
filterByBoolMask_2 = List.FilterByBoolMask(list=all_elements_of_category, mask=endsWith_2)
parameterByName_3 = Parameter.ParameterByName(element=filterByBoolMask_2.in, name=string_2)
value_3 = Parameter.Value(parameterByName_3)
string_6 = StringInput("-L1")
add_2 = value_3 + string_6
setParameterByName_3 = Element.SetParameterByName(element=filterByBoolMask_2.in, parameterName=string, value=add_2)
setParameterByName_4 = Element.SetParameterByName(element=setParameterByName_3, parameterName=string_4, value=string_5)
endsWith_3 = String.EndsWith(clean, code_block_2.out2)
filterByBoolMask_3 = List.FilterByBoolMask(list=all_elements_of_category, mask=endsWith_3)
parameterByName_4 = Parameter.ParameterByName(element=filterByBoolMask_3.in, name=string_2)
value_4 = Parameter.Value(parameterByName_4)
string_7 = StringInput("-L2")
add_3 = value_4 + string_7
setParameterByName_5 = Element.SetParameterByName(element=filterByBoolMask_3.in, parameterName=string, value=add_3)
setParameterByName_6 = Element.SetParameterByName(element=setParameterByName_5, parameterName=string_4, value=string_5)
endsWith_4 = String.EndsWith(clean, code_block_2.out3)
filterByBoolMask_4 = List.FilterByBoolMask(list=all_elements_of_category, mask=endsWith_4)
parameterByName_5 = Parameter.ParameterByName(element=filterByBoolMask_4.in, name=string_2)
value_5 = Parameter.Value(parameterByName_5)
string_8 = StringInput("-LR")
add_4 = value_5 + string_8
setParameterByName_7 = Element.SetParameterByName(element=filterByBoolMask_4.in, parameterName=string, value=add_4)
setParameterByName_8 = Element.SetParameterByName(element=setParameterByName_7, parameterName=string_4, value=string_5)
