# Dynamo graph ChangeTextType.dyn (Dynamo 1.3.4.6666)

ownerView = Custom[Element.OwnerView]()  # Gets the owner view of a given Revit element (if possible); unwired: element
filterByName = Custom[Elements.FilterByName]()  # Retrieves those elements from a collection whose names match the search string; unwired: elements, searchString
ownerView_2 = Custom[Element.OwnerView]()  # unwired: element
categories = Categories("TextNotes")
all_elements_of_category = ElementsOfCategory(categories)
typename = TextNote.Typename(all_elements_of_category)
code_block = CodeBlock { "SLAB NOTES - LEVEL 01/02"; }
contains = String.Contains(str=typename, searchFor=code_block)
filterByBoolMask = List.FilterByBoolMask(list=all_elements_of_category, mask=contains)
ownerView_3 = Custom[Element.OwnerView](element=filterByBoolMask.in)
type = Custom[View.Type](view=ownerView_3)  # Returns the type of a given view
string_from_object = FromObject(type)
code_block_2 = CodeBlock { "DraftingView"; }
contains_2 = String.Contains(str=string_from_object, searchFor=code_block_2)
filterByBoolMask_2 = List.FilterByBoolMask(list=filterByBoolMask.in, mask=contains_2)
code_block_3 = CodeBlock { "Type"; }
passthrough = Custom[Passthrough](passThrough=code_block_3, waitFor=filterByBoolMask_2.in)  # Forces a sequential order of execution. The node wired into the output of the Passthrough node will be executed *after* the node wired into the waitFor input (e.g. important for some Revit operations). The value of the passThrough input will be passed on to the node wired into the output port of the Passthrough node.
code_block_4 = CodeBlock { "2.5mm Arial Op"; }
byName = TextNoteType.ByName(code_block_4)
setParameterByName = Element.SetParameterByName(element=filterByBoolMask_2.in, parameterName=passthrough, value=byName)
typename_2 = TextNote.Typename(setParameterByName)
