# Dynamo graph CopyLegendsAcrossSheets.dyn (Dynamo 1.3.4.6666)

file_path = Filename("R:\Standards\Revit\RDG Startup Files\Dynamo Player\Images\rdg_logo_color_process.png")
code_block = CodeBlock { "CANCEL"; 600; "PLACE LEGEND ON SHEETS"; }
code_block_2 = CodeBlock { "SELECT LEGENDS"; }
categories = Categories("Viewports")
boolean = BoolSelector(false)
ui_selectmodelelements_data = Custom[UI.SelectModelElements Data](InputName=code_block_2, ButtonText=code_block_2, CategoryFilter=categories, SelectSingleElement=boolean)  # Creates a Revit element selection input for UI.MultipleInputForm++ . Check out www.data-shapes.net for more infos!
code_block_3 = CodeBlock { "Legend to Place"; "Select Sheets"; "View Title"; }
sheets = Python()  # unwired: IN[0]
# ---------- sheets.python (36 lines) ----------
#Copyright(c) 2017, john pierson
# @60secondrevit, http://sixtysecondrevit.com

import clr
clr.AddReference('ProtoGeometry')
from Autodesk.DesignScript.Geometry import *

# Import DocumentManager and TransactionManager
clr.AddReference("RevitServices")
import RevitServices
from RevitServices.Persistence import DocumentManager
from RevitServices.Transactions import TransactionManager

# Import RevitAPI
clr.AddReference("RevitAPI")
import Autodesk
from Autodesk.Revit.DB import *

doc = DocumentManager.Instance.CurrentDBDocument
uiapp = DocumentManager.Instance.CurrentUIApplication
app = uiapp.Application

from System.Collections.Generic import *


#The inputs to this node will be stored as a list in the IN variable.
dataEnteringNode = IN
collector = FilteredElementCollector(doc)
sheets= collector.OfCategory(BuiltInCategory.OST_Sheets).WhereElementIsNotElementType().ToElements()

sheet = []
for i in sheets:
	if not i.IsPlaceholder:
		sheet.append(i)

OUT = sheet
# ----------------------------------------
sheetNumber = Sheet.SheetNumber(sheets)
sheetName = Sheet.SheetName(sheets)
code_block_4 = CodeBlock(a=sheetNumber, b=sheetName) { a+" - "+b; }
code_block_5 = CodeBlock { 300; }
boolean_2 = BoolSelector(true)
boolean_3 = BoolSelector(false)
ui_listview_data = Custom[UI.Listview Data](InputName=code_block_3.out1, Keys=code_block_4, Values=sheets, Height_optionnal=code_block_5, SortItems_optionnal=boolean_2, ShowId_optionnal=boolean_3)  # Create data for ListView input in UI.MultiInputForm ++ . Check out www.data-shapes.net for more infos.
get_all_viewport_types = Custom[Get All Viewport Types]()  # This node will retrieve all Viewport Types currently in the model.
name = Element.Name(get_all_viewport_types)
code_block_6 = CodeBlock { 1; }
ui_dropdown_data = Custom[UI.DropDown Data](InputName=code_block_3.out2, Keys=name, Values=get_all_viewport_types, DefaultValueIndex=code_block_6, Sorted_optional=boolean_2)  # Create data for DropDown input in UI.MultiInputForm ++ . Check out www.data-shapes.net for more infos.
create = List.Create(ui_selectmodelelements_data, ui_listview_data, ui_dropdown_data)
boolean_4 = BoolSelector(true)
ui_multipleinputform = Custom[UI.MultipleInputForm ++](Logo_optional=file_path, ButtonText_optional=code_block.out2, Inputs=create, Toggle=boolean_4, CancelButtonText_optional=code_block.out0, Width_optional=code_block.out1)  # Create a form with multiple inputs. see www.data-shapes.net for tutorials and infos!
code_block_7 = CodeBlock(seq=ui_multipleinputform.User_Inputs) { seq[1]; {seq[0]}; {seq[2]}; }
count = Count(code_block_7.out0)
cycle = List.Cycle(list=code_block_7.out0, amount=count)
getView = Rhythm.Revit.Elements.Viewport.GetView(code_block_7.out1)
cycle_2 = List.Cycle(list=getView, amount=count)
cycle_3 = List.Cycle(list=code_block_7.out1, amount=count)
locationData = Rhythm.Revit.Elements.Viewport.LocationData(cycle_3)
create_2 = Rhythm.Revit.Elements.Viewport.Create(cycle, cycle_2, locationData.out1)
code_block_8 = CodeBlock { "Type"; }
cycle_4 = List.Cycle(list=code_block_7.out2, amount=count)
setParameterByName = Element.SetParameterByName(element=create_2, parameterName=code_block_8, value=cycle_4)
