# Dynamo graph CopyViewsFromLinks.dyn (Dynamo 1.3.4.6666)

links = Links()
getDocument = Rhythm.Revit.Elements.RevitLink.GetDocument(links)
categories = Categories("Views")
get_all_elements_from_linked = Custom[Get All Elements From Linked Model](LinkDoc=getDocument, Category=categories)  # This node is based on code posted by Julien Benoit. Big thanks to Julien for sharing his work. This node will retrieve all elements of a given category from a given linked model.
isNull = Object.IsNull(get_all_elements_from_linked)
filterByBoolMask = List.FilterByBoolMask(list=get_all_elements_from_linked, mask=isNull)
code_block = CodeBlock { "Working View"; }
getParameterValueByName = Element.GetParameterValueByName(element=filterByBoolMask.in, parameterName=code_block)
code_block_2 = CodeBlock { "4900"; }
contains = String.Contains(str=getParameterValueByName, searchFor=code_block_2)
filterByBoolMask_2 = List.FilterByBoolMask(list=filterByBoolMask.in, mask=contains)
copyFromLinkInstance = Custom[Springs.Doc.CopyFromLinkInstance](LinkInstance=links, element=filterByBoolMask_2.in)  # The node will use the total transformation of the link instance to copy the input elements into the local document.
