# Dynamo graph RepathLinks.dyn (Dynamo 1.3.4.6666)

get_revit_link_file_path = Custom[Get Revit Link File Path Information]()  # for current doc
get_rvt_link_filenames_with = Custom[Get RVT Link Filenames with Element and Type Workset Info](rvtLinkInstances=get_revit_link_file_path.PathToFile)
directoryName = FilePath.DirectoryName(get_rvt_link_filenames_with.Instance_Elements)
directory_path = Directory("R:\Construction\01 Construction Projects\045 - Te Awa\03.0 Stage RMB\3.1.1 Commercial Drawings & Specs\Revit\Revit Central Files\Models")
string = StringInput("\")
string_2 = StringInput("\")
split = String.Split(get_rvt_link_filenames_with.Instance_Elements, string_2)
lastItem = List.LastItem(split, lacing=Longest)
code_block = CodeBlock(x=lastItem) { (String.Contains(x,"ARCH") || String.Contains(x,"GRIDS")); }
filterByBoolMask = List.FilterByBoolMask(list=lastItem, mask=code_block)
code_block_2 = CodeBlock { "042_AH"; "045_TA"; }
replace = String.Replace(str=filterByBoolMask.in, searchFor=code_block_2.out0, replaceWith=code_block_2.out1)
code_block_3 = CodeBlock(A=directory_path, B=string, C=replace) { A+B+C; }
filterByBoolMask_2 = List.FilterByBoolMask(list=get_rvt_link_filenames_with.Instance_Elements, mask=code_block)
reload = Custom[RevitLinkType.Reload]()  # Reloads a Revit or IFC link.; unwired: revitLinkType
openDocumentFile = Rhythm.Revit.Application.Application.OpenDocumentFile()  # unwired: arg0
save_to_central_with_options = Custom[Save To Central with Options]()  # unwired: Document, FilePath
directory_path_2 = Directory("R:\Construction\01 Construction Projects\045 - Te Awa\03.0 Stage RMB\3.1.1 Commercial Drawings & Specs\Revit\Revit Central Files\Models")
fromPath = DirectoryObject(directory_path_2)  # "Directory.FromPath"
contents = Directory.Contents(fromPath)
code_block_4 = CodeBlock(x=contents) { (String.Contains(x,"045_TA_RMB_ARCH") || String.Contains(x,"GRIDS")); }
filterByBoolMask_3 = List.FilterByBoolMask(list=contents, mask=code_block_4)
flatten = Flatten(filterByBoolMask_3.in)
directory_path_3 = Directory("R:\Construction\01 Construction Projects\045 - Te Awa\03.0 Stage RMB\3.1.1 Commercial Drawings & Specs\Revit\Revit Central Files\Models")
boolean = BoolSelector(true)
python_script = Python(IN[0]=flatten, IN[1]=directory_path_3, IN[2]=boolean)
# ---------- python_script.python (129 lines) ----------
import clr
clr.AddReference('ProtoGeometry')
from Autodesk.DesignScript.Geometry import *

# Import RevitAPI
clr.AddReference("RevitAPI")
import Autodesk
from Autodesk.Revit.DB import *
from Autodesk.Revit.Attributes import*


import clr
clr.AddReference("RevitAPIUI")
from  Autodesk.Revit.UI import *

# Import DocumentManager and TransactionManager
clr.AddReference("RevitServices")
import RevitServices
from RevitServices.Persistence import DocumentManager
from RevitServices.Transactions import TransactionManager

from System.Collections.Generic import *

# Import Revit Nodes
clr.AddReference("RevitNodes")
import Revit
clr.ImportExtensions(Revit.Elements)
clr.ImportExtensions(Revit.GeometryConversion)

# Import python library
import sys
pyt_path = r'C:\Program Files (x86)\IronPython 2.7\Lib'
sys.path.append(pyt_path)
import os

tOptions = TransactWithCentralOptions()

doc = DocumentManager.Instance.CurrentDBDocument
uiapp = DocumentManager.Instance.CurrentUIApplication
app = uiapp.Application
uidoc = DocumentManager.Instance.CurrentUIApplication.ActiveUIDocument

def flatten(*args):
    for x in args:
        if hasattr(x, '__iter__'):
            for y in flatten(*x): yield y
        else: yield x
	

#Credits Archi-lab
def checkParameter(param):
	for p in param:
		internal = p.Definition
		if internal.BuiltInParameter != BuiltInParameter.INVALID:
			return p
	return param[0]

def GetParaValue(params):
	paravalue = []
	p = checkParameter(params)
	if p.StorageType == StorageType.String:
		paravalue.append(p.AsString())
	elif p.StorageType == StorageType.ElementId:
		paravalue.append(p.AsValueString())
	elif p.StorageType == StorageType.Integer:
		paravalue.append(p.AsValueString())
	else:
		paravalue.append(None)
	return paravalue
	
if isinstance(IN[0], list):
	file = IN[0]
	#filename = IN[2]
else:
	file = [IN[0]]
	#filename = [IN[2]]

newpath = IN[1]
LinkNames, newdocpath, results, unloadstatus, linkParas = [], [], [], [], []

# set open option to open as a local file
openConfig = WorksetConfiguration(WorksetConfigurationOption.CloseAllWorksets)
oOptions = OpenOptions()
oOptions.DetachFromCentralOption = DetachFromCentralOption.DoNotDetach
oOptions.Audit = False
oOptions.SetOpenWorksetsConfiguration(openConfig)

worksharingOptions = WorksharingSaveAsOptions()
worksharingOptions.SaveAsCentral = True

rOptions = RelinquishOptions(False)
rOptions.StandardWorksets = True
rOptions.ViewWorksets = True
rOptions.FamilyWorksets = True
rOptions.UserWorksets = True
rOptions.CheckedOutElements = True

sOptions = SynchronizeWithCentralOptions()
sOptions.SetRelinquishOptions(rOptions)
sOptions.Compact = True
sOptions.SaveLocalBefore = True
sOptions.SaveLocalAfter = True

TransactionManager.Instance.ForceCloseTransaction()

if IN[2]:
	try:
		for files in file:
			modelpath = FilePath(files)
			newdoc = app.OpenDocumentFile(modelpath,oOptions)
			collector = Autodesk.Revit.DB.FilteredElementCollector(newdoc)
			linkTypes = UnwrapElement(collector.OfClass(Autodesk.Revit.DB.RevitLinkType))
			for linkType in flatten(linkTypes):
				linkPara = linkType.GetParameters("Type Name")
				linkParavalue = GetParaValue(linkPara)
				try:
					linkType.LoadFrom(newpath, None)
					unloadstatus.append(True)
				except:
					unloadstatus.append(False)
				results = [unloadstatus]		
			newdoc.Save()
			newdoc.SynchronizeWithCentral(tOptions,sOptions)
			newdoc.Close(True)
			#newdocpath.append(newfilepath) 
			OUT = newdocpath 	
	except Exception,e:
		OUT = str(e)
else: OUT = "Please set IN[3] to true"
# ----------------------------------------
