# Dynamo graph UpgradeandCleanModels.dyn (Dynamo 1.3.4.6666)

# group: FOR SHEETS
directory_path = Directory("R:\Construction\01 Construction Projects\01.1 Existing Design\042 Avonhead\Project CAD Files - Regional Main Building\Revit\Revit Central Files\Sheets")
code_block = CodeBlock { "*.rvt"; }
contents = Custom[Directory.Contents+](directoryPath=directory_path, searchString=code_block)  # Unlike the built-in node Directory.Contents, this node browses a directory recursively and returns all relevant files contained in subfolders as well.
code_block_2 = CodeBlock { "042_"; }
contains = String.Contains(str=contents, searchFor=code_block_2)
filterByBoolMask = List.FilterByBoolMask(list=contents, mask=contains)

# group: 1st STEP - CREATE A*** FOLDERS - CONNECT TO LAST NODE AND THEN DISCONNECT
directory_path_2 = Directory("R:\Construction\01 Construction Projects\045 - Te Awa\03.0 Stage RMB\3.1.1 Commercial Drawings & Specs\Revit\Revit Central Files\Sheets")
directoryName = FilePath.DirectoryName(filterByBoolMask.in)
uniqueItems = List.UniqueItems(directoryName)
code_block_3 = CodeBlock { "00"; }
contains_2 = String.Contains(str=uniqueItems, searchFor=code_block_3)
filterByBoolMask_2 = List.FilterByBoolMask(list=uniqueItems, mask=contains_2)
string = StringInput("\")
split = String.Split(filterByBoolMask_2.in, string)
lastItem = List.LastItem(split, lacing=Longest)
code_block_4 = CodeBlock(A=directory_path_2, B=lastItem) { A+"\\"+B; }
fromPath = DirectoryObject()  # "Directory.FromPath"; unwired: arg0

# group: 2nd STEP - OPEN ORIGINAL FILE AND SAVE AS TO NEW FOLDER
code_block_5 = CodeBlock { "00"; }
contains_3 = String.Contains(str=filterByBoolMask.in, searchFor=code_block_5)
boolean = BoolSelector(false)

# group: OLD SHEET PATH
filterByBoolMask_3 = List.FilterByBoolMask(list=filterByBoolMask.in, mask=contains_3)

# group: NEW SHEET PATH replace old \sheet file path with new one
old_master_sheets_file = Directory("R:\Construction\01 Construction Projects\01.1 Existing Design\042 Avonhead\Project CAD Files - Regional Main Building\Revit\Revit Central Files\Sheets")
new_master_sheets_path = Directory("R:\Construction\01 Construction Projects\045 - Te Awa\03.0 Stage RMB\3.1.1 Commercial Drawings & Specs\Revit\Revit Central Files\Sheets")
replace = String.Replace(str=filterByBoolMask_3.in, searchFor=old_master_sheets_file, replaceWith=new_master_sheets_path)
code_block_6 = CodeBlock { "042_"; "045_"; }
replace_2 = String.Replace(str=replace, searchFor=code_block_6.out0, replaceWith=code_block_6.out1)

# group (continued): 2nd STEP - OPEN ORIGINAL FILE AND SAVE AS TO NEW FOLDER
python_script = Python(IN[0]=filterByBoolMask_3.in, IN[1]=replace_2, IN[2]=boolean)
# ---------- python_script.python (129 lines) ----------
import clr
clr.AddReference('ProtoGeometry')
from Autodesk.DesignScript.Geometry import *

# Import RevitAPI
clr.AddReference("RevitAPI")
import Autodesk
from Autodesk.Revit.DB import *
from Autodesk.Revit.Attributes import*

import clr
clr.AddReference("RevitAPIUI")
from  Autodesk.Revit.UI import *

# Import DocumentManager and TransactionManager
clr.AddReference("RevitServices")
import RevitServices
from RevitServices.Persistence import DocumentManager
from RevitServices.Transactions import TransactionManager

from System.Collections.Generic import *

# Import Revit Nodes
clr.AddReference("RevitNodes")
import Revit
clr.ImportExtensions(Revit.Elements)
clr.ImportExtensions(Revit.GeometryConversion)

# Import python library
import sys
pyt_path = r'C:\Program Files (x86)\IronPython 2.7\Lib'
sys.path.append(pyt_path)
import os

tOptions = TransactWithCentralOptions()

doc = DocumentManager.Instance.CurrentDBDocument
uiapp = DocumentManager.Instance.CurrentUIApplication
app = uiapp.Application
uidoc = DocumentManager.Instance.CurrentUIApplication.ActiveUIDocument

def flatten(*args):
    for x in args:
        if hasattr(x, '__iter__'):
            for y in flatten(*x): yield y
        else: yield x
	

#Credits Archi-lab
def checkParameter(param):
	for p in param:
		internal = p.Definition
		if internal.BuiltInParameter != BuiltInParameter.INVALID:
			return p
	return param[0]

def GetParaValue(params):
	paravalue = []
	p = checkParameter(params)
	if p.StorageType == StorageType.String:
		paravalue.append(p.AsString())
	elif p.StorageType == StorageType.ElementId:
		paravalue.append(p.AsValueString())
	elif p.StorageType == StorageType.Integer:
		paravalue.append(p.AsValueString())
	else:
		paravalue.append(None)
	return paravalue
	
origFiles = IN[0]
newFiles = IN[1]

LinkNames, newdocpath, results, unloadstatus, linkParas = [], [], [], [], []

openConfig = WorksetConfiguration(WorksetConfigurationOption.CloseAllWorksets)
oOptions = OpenOptions()
oOptions.DetachFromCentralOption = DetachFromCentralOption.DetachAndPreserveWorksets
oOptions.Audit = True
oOptions.SetOpenWorksetsConfiguration(openConfig)

worksharingOptions = WorksharingSaveAsOptions()
worksharingOptions.SaveAsCentral = True

SaveOptions = SaveAsOptions()
SaveOptions.MaximumBackups = 10
SaveOptions.SetWorksharingOptions(worksharingOptions)
SaveOptions.OverwriteExistingFile = True

rOptions = RelinquishOptions(False)
rOptions.StandardWorksets = True
rOptions.ViewWorksets = True
rOptions.FamilyWorksets = True
rOptions.UserWorksets = True
rOptions.CheckedOutElements = True

sOptions = SynchronizeWithCentralOptions()
sOptions.SetRelinquishOptions(rOptions)
sOptions.Compact = True
sOptions.SaveLocalBefore = True
sOptions.SaveLocalAfter = True

TransactionManager.Instance.ForceCloseTransaction()

if IN[2]:
	try:
		for origFile,newFile in zip(origFiles,newFiles):
			modelpath = FilePath(origFile)
			newdoc = app.OpenDocumentFile(modelpath,oOptions)
			collector = Autodesk.Revit.DB.FilteredElementCollector(newdoc)
			linkTypes = UnwrapElement(collector.OfClass(Autodesk.Revit.DB.RevitLinkType))
			#unload links
			for linkType in flatten(linkTypes):
				linkPara = linkType.GetParameters("Type Name")
				linkParavalue = GetParaValue(linkPara)
				try:
					linkType.Unload(None)
					unloadstatus.append(True)
				except:
					unloadstatus.append(False)
				results = [unloadstatus]	

			newdoc.SaveAs(newFile,SaveOptions)			
			newdoc.SynchronizeWithCentral(tOptions,sOptions)
			newdoc.Close(True)
			newdocpath.append(newFile) 
			OUT = newdocpath 	
	except Exception,e:
		OUT = str(e)
else: OUT = "Please set IN[3] to true"
# ----------------------------------------

# group: FOR MODELS
directory_path_3 = Directory("R:\Construction\01 Construction Projects\01.1 Existing Design\042 Avonhead\Project CAD Files - Regional Main Building\Revit\Revit Central Files\Models")
fromPath_2 = DirectoryObject(directory_path_3)  # "Directory.FromPath"
contents_2 = Directory.Contents(fromPath_2)
code_block_7 = CodeBlock { "042_AH_RMB"; }
contains_4 = String.Contains(str=contents_2, searchFor=code_block_7)
filterByBoolMask_4 = List.FilterByBoolMask(list=contents_2, mask=contains_4)
code_block_8 = CodeBlock { "rvt"; }
contains_5 = String.Contains(str=filterByBoolMask_4.in, searchFor=code_block_8)
filterByBoolMask_5 = List.FilterByBoolMask(list=filterByBoolMask_4.in, mask=contains_5)
boolean_2 = BoolSelector(false)

remove_scooter_store_fed_model = CodeBlock { {5,7}; }
removeItemAtIndex = List.RemoveItemAtIndex(list=filterByBoolMask_5.in, indices=remove_scooter_store_fed_model)

# group: NEW MODEL PATH replace old \models file path with new one
directory_path_4 = Directory("R:\Construction\01 Construction Projects\01.1 Existing Design\042 Avonhead\Project CAD Files - Regional Main Building\Revit\Revit Central Files\Models")
directory_path_5 = Directory("R:\Construction\01 Construction Projects\045 - Te Awa\03.0 Stage RMB\3.1.1 Commercial Drawings & Specs\Revit\Revit Central Files\Models")
replace_3 = String.Replace(str=removeItemAtIndex, searchFor=directory_path_4, replaceWith=directory_path_5)
code_block_9 = CodeBlock { "042_"; "045_"; }
replace_4 = String.Replace(str=replace_3, searchFor=code_block_9.out0, replaceWith=code_block_9.out1)

# group (continued): FOR MODELS
python_script_2 = Python(IN[0]=removeItemAtIndex, IN[1]=replace_4, IN[2]=boolean_2)  # same code as python_script
