# Dynamo graph DeleteLineStyles.dyn (Dynamo 1.3.4.6666)

python_script = Python()
# ---------- python_script.python (35 lines) ----------
import clr
clr.AddReference('ProtoGeometry')
from Autodesk.DesignScript.Geometry import *
clr.AddReference("RevitNodes")
import Revit
clr.ImportExtensions(Revit.Elements)
clr.ImportExtensions(Revit.GeometryConversion)
clr.AddReference("RevitServices")
import RevitServices
from RevitServices.Persistence import DocumentManager
from RevitServices.Transactions import TransactionManager
from System.Collections.Generic import *

clr.AddReference("RevitAPI")
import Autodesk
from Autodesk.Revit.DB import *
doc = DocumentManager.Instance.CurrentDBDocument
uiapp = DocumentManager.Instance.CurrentUIApplication
app = uiapp.Application
uidoc=DocumentManager.Instance.CurrentUIApplication.ActiveUIDocument

TransactionManager.Instance.EnsureInTransaction(doc)
lineStyle = doc.Settings.Categories.get_Item(BuiltInCategory.OST_Lines)
lineStyleSubTypes = lineStyle.SubCategories
listNames = []
listId = []

for i in lineStyleSubTypes:
  name = i.Name
  ID = i.Id
  listNames.append(name)
  listId.append(ID)

TransactionManager.Instance.TransactionTaskDone()
OUT = listNames, listId
# ----------------------------------------
integer_slider = IntegerSlider(1, range=0..100 step 1)
getItemAtIndex = List.GetItemAtIndex(list=python_script, index=integer_slider)

# group: get all lines types used in project
categories = Categories("Lines")
all_elements_of_category = ElementsOfCategory(categories)
code_block = CodeBlock(x=all_elements_of_category) { x.GetParameterValueByName("Line Style"); }
uniqueItems = List.UniqueItems(code_block)
name = Category.Name(uniqueItems)

integer_slider_2 = IntegerSlider(0, range=0..100 step 1)
getItemAtIndex_2 = List.GetItemAtIndex(list=python_script, index=integer_slider_2)
string_from_object = FromObject(getItemAtIndex_2)
containsItem = List.ContainsItem(list=name, item=string_from_object)
filterByBoolMask = List.FilterByBoolMask(list=getItemAtIndex, mask=containsItem)

# group: filter out Revit OOTB lines
string_from_object_2 = FromObject(filterByBoolMask.out)
toNumber = String.ToNumber(string_from_object_2)
code_block_2 = CodeBlock(x=toNumber) { x<0; }

filterByBoolMask_2 = List.FilterByBoolMask(list=filterByBoolMask.out, mask=code_block_2)

# group: DELETE
boolean = BoolSelector(false)
python_script_2 = Python(IN[0]=filterByBoolMask_2.out, IN[1]=boolean)
# ---------- python_script_2.python (35 lines) ----------
import clr
clr.AddReference('ProtoGeometry')
from Autodesk.DesignScript.Geometry import *

clr.AddReference("RevitServices")
import RevitServices
from RevitServices.Persistence import DocumentManager
from RevitServices.Transactions import TransactionManager

clr.AddReference("RevitAPI")
import Autodesk
from Autodesk.Revit.DB import *
doc = DocumentManager.Instance.CurrentDBDocument
uiapp = DocumentManager.Instance.CurrentUIApplication
app = uiapp.Application
from System.Collections.Generic import *

x = IN[0]
Left = list()
Erased = list()

TransactionManager.Instance.EnsureInTransaction(doc)

if IN[1]:
	for Id in x:
	  try:
	    doc.Delete(Id)
	    Erased.append(Id)
	  except:
	    Left.append(Id)
	  OUT = Erased, Left
else:
	OUT=("set to True")

TransactionManager.Instance.TransactionTaskDone()
# ----------------------------------------

# group: PURGE LINE PATTERNS
element_types = ElementTypes("LinePatternElement")
all_elements_of_type = ElementsOfType(element_types)
name_2 = Element.Name(all_elements_of_type)
code_block_3 = CodeBlock { {"IMPORT","strich"}; true; }
contains = Custom[String.Contains](StringList=name_2, FilterList=code_block_3.out0)  # This node takes a list of strings and checks if any string contains a matching string from filter input.
filterByBoolMask_3 = List.FilterByBoolMask(list=all_elements_of_type, mask=contains)
watch = Watch(filterByBoolMask_3.in)
boolean_2 = BoolSelector(false)
python_script_3 = Python(IN[0]=watch, IN[1]=boolean_2)
# ---------- python_script_3.python (50 lines) ----------
#Copyright(c) 2014, Konrad Sobon
# @arch_laboratory, http://archi-lab.net

import clr
clr.AddReference('ProtoGeometry')
from Autodesk.DesignScript.Geometry import *

# Import DocumentManager and TransactionManager
clr.AddReference("RevitServices")
import RevitServices
from RevitServices.Persistence import DocumentManager
from RevitServices.Transactions import TransactionManager

# Import RevitAPI
clr.AddReference("RevitAPI")
import Autodesk
from Autodesk.Revit.DB import *

doc = DocumentManager.Instance.CurrentDBDocument
uiapp = DocumentManager.Instance.CurrentUIApplication
app = uiapp.Application

from System.Collections.Generic import *

#The inputs to this node will be stored as a list in the IN variable.
dataEnteringNode = IN

#unwrap all elements to use with API
elements = []
for i in IN[0]:
	elements.append(UnwrapElement(i))

idsToDelete = List[Autodesk.Revit.DB.ElementId]()
for i in elements:
	idsToDelete.Add(i.Id)

if IN[1]:
	# "Start" the transaction
	TransactionManager.Instance.EnsureInTransaction(doc)
	
	doc.Delete(idsToDelete)
	
	# "End" the transaction
	TransactionManager.Instance.TransactionTaskDone()
	
	message = "You have successfully deleted n " + str(idsToDelete.Count) + " elements from Revit model."
	
	OUT = 'n'.join('{:^35}'.format(s) for s in message.split('n'))
else:
	OUT = "set to true"
# ----------------------------------------
