# Dynamo graph DeleteViewTemplates&Fiters.dyn (Dynamo 1.3.4.6666)

element_types = ElementTypes("FilterElement")
all_elements_of_type = ElementsOfType(element_types)
name = Element.Name(all_elements_of_type)
ownerViews = archilab.Revit.Elements.ViewFilter.OwnerViews(all_elements_of_type)
isEmpty = List.IsEmpty(ownerViews, lacing=Longest)
filterByBoolMask = List.FilterByBoolMask(list=all_elements_of_type, mask=isEmpty)
watch = Watch(filterByBoolMask.out)
name_2 = Element.Name(watch)
delete = archilab.Revit.Elements.Elements.Delete()  # unwired: arg0
element_types_2 = ElementTypes("View")
all_elements_of_type_2 = ElementsOfType(element_types_2)
viewTemplate = Custom[View.ViewTemplate](view=all_elements_of_type_2)  # Returns the view template assigned to a given view (if one is assigned)
