# Dynamo graph DeleteTextContaining.dyn (Dynamo 1.3.4.6666)

select_rule_type = RuleTypes("BeginsWith")
code_block = CodeBlock { "3"; }
categories = Categories("TextNotes")
all_elements_of_category = ElementsOfCategory(categories)
typename = TextNote.Typename(all_elements_of_category)
string = StringInput("3.0mm bold")
boolean = BoolSelector(true)
contains = String.Contains(str=typename, searchFor=string, ignoreCase=boolean)
filterByBoolMask = List.FilterByBoolMask(list=all_elements_of_category, mask=contains)
text = TextNote.Text(filterByBoolMask.in)
string_2 = StringInput("BCN20188056")
contains_2 = String.Contains(str=text, searchFor=string_2, ignoreCase=boolean)
filterByBoolMask_2 = List.FilterByBoolMask(list=filterByBoolMask.in, mask=contains_2)
delete = archilab.Revit.Elements.Elements.Delete(filterByBoolMask_2.in)
