# Dynamo graph DimensionColumnToGrid.dyn (Dynamo 1.3.4.6666)

code_block = CodeBlock()
# ---------- code_block.designscript (43 lines) ----------
"
import clr
clr.AddReference('RevitAPI')
from Autodesk.Revit.DB import*
clr.AddReference('RevitServices')
from RevitServices.Persistence import DocumentManager
from RevitServices.Transactions import TransactionManager
doc = DocumentManager.Instance.CurrentDBDocument
clr.AddReference('RevitNodes')
import Revit
clr.ImportExtensions(Revit.Elements)
clr.ImportExtensions(Revit.GeometryConversion)

col = UnwrapElement(IN[0])
grid = UnwrapElement(IN[1])
lines = UnwrapElement(IN[2])

geomopt = Options()
geomopt.ComputeReferences = True
geomopt.IncludeNonVisibleObjects = True
geomopt.View = doc.ActiveView

ref = []
for i in col:
 r = (i.get_Geometry(geomopt))
 [ref.append(j.Reference) for j in r if str(j).Contains('Point')]

refg = []

dim = []

TransactionManager.Instance.EnsureInTransaction(doc)
for i,j,k in zip(ref,grid,lines):
 refarr = ReferenceArray()
 refarr.Clear()
 refarr.Append(i)
 refarr.Append(Reference(j))
 dim.append(doc.Create.NewDimension(doc.ActiveView, k.ToRevitType(), refarr))
TransactionManager.Instance.TransactionTaskDone();

OUT = dim;

";
# ----------------------------------------
categories = Categories("StructuralColumns")
all_elements_of_category = ElementsOfCategory(categories)
categories_2 = Categories("Grids")
all_elements_of_category_2 = ElementsOfCategory(categories_2)
code_block_2 = CodeBlock(col=all_elements_of_category, elem=all_elements_of_category_2)
# ---------- code_block_2.designscript (45 lines) ----------
pp = col.GetLocation();
p = Point.ByCoordinates(pp.X,pp.Y,0);

e = elem.Curve;

//separate horizontal and vertical grids
sp = e.StartPoint;
ep = e.EndPoint;
m = Math.Abs(sp.Y-ep.Y) > Math.Abs(sp.X-ep.X);
filter = DSCore.List.FilterByBoolMask(e,m);
filterelem = DSCore.List.FilterByBoolMask(elem,m);
YGrids = filter["in"].PullOntoPlane(Plane.XY());
XGrids = filter["out"].PullOntoPlane(Plane.XY());
YGridselem = filterelem["in"];
XGridselem = filterelem["out"];

//separate columns that are not on a grid
//not on x grids
m1x = Geometry.DoesIntersect(pp<1>, XGrids);
m1xx = List.ContainsItem(m1x<1>, true);
filter1x = DSCore.List.FilterByBoolMask(col, m1xx);
colNotOnX = filter1x["out"];
pointNotOnX = colNotOnX.GetLocation();

//not on y grids
m1y = Geometry.DoesIntersect(pp<1>, YGrids);
m1yy = List.ContainsItem(m1y<1>, true);
filter1y = DSCore.List.FilterByBoolMask(col, m1yy);
colNotOnY = filter1y["out"];
pointNotOnY = colNotOnY.GetLocation();

//Building direction lines for dimensions
xdist = pointNotOnX<1>.DistanceTo(XGrids);
ydist = pointNotOnY<1>.DistanceTo(YGrids);

xi = DSCore.List.FirstItem(SortIndexByValue(xdist)<1>);
yi = DSCore.List.FirstItem(SortIndexByValue(ydist)<1>);

gx = XGridselem[xi];
gy = YGridselem[yi];
//----------------
cpX = XGrids[xi].ClosestPointTo(pointNotOnX);
lx = Line.ByStartPointEndPoint(pointNotOnX,cpX);
cpY = YGrids[yi].ClosestPointTo(pointNotOnY);
ly = Line.ByStartPointEndPoint(pointNotOnY,cpY);
# ----------------------------------------
code_block_3 = CodeBlock { 500; }
offset = Curve.Offset(curve=code_block_2.lx, distance=code_block_3)
python_script_from_string = PythonStringNode(script=code_block, IN[0]=code_block_2.colNotOnX, IN[1]=code_block_2.gx, IN[2]=offset)
offset_2 = Curve.Offset(curve=code_block_2.ly, distance=code_block_3)
python_script_from_string_2 = PythonStringNode(script=code_block, IN[0]=code_block_2.colNotOnY, IN[1]=code_block_2.gy, IN[2]=offset_2)
