# Dynamo graph DoorHanding.dyn (Dynamo 2.0.3.8810)

categories = Categories(index=159)
all_elements_of_category = ElementsOfCategory(Category=categories)
name = Element.Name(element=all_elements_of_category)
code_block = CodeBlock { "HS-"; }
startsWith = String.StartsWith(str=name, searchFor=code_block)
filterByBoolMask = List.FilterByBoolMask(list=all_elements_of_category, mask=startsWith)
current = Document.Current()
activeView = Document.ActiveView(document=current)
getLocation = Element.GetLocation(element=all_elements_of_category)
facingOrientation = FamilyInstance.FacingOrientation(familyInstance=all_elements_of_category)
handOrientation = Custom[FamilyInstance.HandOrientation](familyInstance=all_elements_of_category)  # Gets the hand orientation of a hosted object (e.g. a window or a door)
add = Vector.Add(vector=facingOrientation, vectorToAdd=handOrientation)
element_host = Custom[Element Host](element=all_elements_of_category)  # Gets the host of the element. Unlike the OOTB node FamilyInstance.GetHost, it also works for elements hosted by a linked document, wall sweeps, foundations, railings and builing pads. Based on a Clockwork's node
orientation = Custom[Wall.Orientation](wall=element_host)  # Gets the orientation of a given wall instance (normal of the exterior face of the wall). Will *not* work for walls hosted on mass faces or in-place walls.
ZAxis = Vector.ZAxis()
angleAboutAxis = Vector.AngleAboutAxis(vector=add, otherVector=orientation, rotationAxis=ZAxis)
round = Math.Round(number=angleAboutAxis)

# group: default handing:
# note: From inside family creation.
# Set TRUE if default is LEFT HANDING.
boolean = BoolSelector(false)

python_script = Python(IN[0]=round, IN[1]=boolean)
# ---------- python_script.python (27 lines) ----------
# Enable Python support and load DesignScript library
import clr
clr.AddReference('ProtoGeometry')
from Autodesk.DesignScript.Geometry import *

# The inputs to this node will be stored as a list in the IN variables.
degrees = IN[0]
defaultHanding = IN[1]

handing = []

for degree in degrees:
	if degree == 45 or degree == 225:
		if defaultHanding:
			handing.append("Left")
		else:
			handing.append("Right")
	else:
		if defaultHanding:
			handing.append("Right")
		else:
			handing.append("Left")

# Place your code below this line

# Assign your output to the OUT variable.
OUT = handing
# ----------------------------------------
code_block_2 = CodeBlock { "Centre"; }
byLocation = TextNote.ByLocation(view=activeView, location=getLocation, text=python_script, alignment=code_block_2)
