# Dynamo graph LINZBuildingOutlines.dyn (Dynamo 2.0.3.8810)

string = StringInput("https://data.linz.govt.nz/services/query/v1/vector.json?key=88d77a928c2945afa202dd295f2286b1&layer=101290&")
siteLocation = SiteLocation()
longitude = DynamoUnits.Location.Longitude(location=siteLocation)
string_from_object = FromObject(obj=longitude)
code_block = CodeBlock(x=string_from_object) { "x="+x; }
latitude = DynamoUnits.Location.Latitude(location=siteLocation)
string_from_object_2 = FromObject(obj=latitude)
code_block_2 = CodeBlock(y=string_from_object_2) { "y="+y; }
code_block_3 = CodeBlock(x=code_block, y=code_block_2) { x+"&"+y; }
string_2 = StringInput("&max_results=16&radius=1000&geometry=true&with_field_names=true")
concat = String.Concat(string0=string, string1=code_block_3, string2=string_2)
byUrl = DynaWeb.WebRequest.ByUrl(url=concat)
execute = DynaWeb.WebRequest.Execute(request=byUrl)
content = DynaWeb.WebResponse.Content(webResponse=execute)
string_3 = JsonData.Utilities.Parse.String(jsonString=content)
toDictionary = JsonData.Elements.JsonObject.ToDictionary(jsonObject=string_3)
code_block_4 = CodeBlock(x=toDictionary) { x["vectorQuery"]["layers"]["101290"]["features"]; }
toDictionary_2 = JsonData.Elements.JsonObject.ToDictionary(jsonObject=code_block_4)
code_block_5 = CodeBlock { "geometry"; }
valueAtKey = DesignScript.Builtin.Dictionary.ValueAtKey(dictionary=toDictionary_2, key=code_block_5)
code_block_6 = CodeBlock { "coordinates"; }
valueAtKey_2 = DesignScript.Builtin.Dictionary.ValueAtKey(dictionary=valueAtKey, key=code_block_6)
code_block_7 = CodeBlock { 1; }
flatten = List.Flatten(list=valueAtKey_2, amt=code_block_7)
code_block_8 = CodeBlock { 0; 1; }
getItemAtIndex = List.GetItemAtIndex(list=flatten@@L2, index=code_block_8.out0)
code_block_9 = CodeBlock(x=getItemAtIndex) { x*1000000; }
getItemAtIndex_2 = List.GetItemAtIndex(list=flatten@@L2, index=code_block_8.out1)
code_block_10 = CodeBlock(x=getItemAtIndex_2) { x*1000000; }
byCoordinates = Point.ByCoordinates(x=code_block_9, y=code_block_10)
getItemAtIndex_3 = List.GetItemAtIndex(list=flatten, index=code_block_8.out0, lacing=Shortest)
getItemAtIndex_4 = List.GetItemAtIndex(list=getItemAtIndex_3, index=code_block_8.out0, lacing=Longest)
code_block_11 = CodeBlock(x=getItemAtIndex_4) { x*-1000000; }
getItemAtIndex_5 = List.GetItemAtIndex(list=getItemAtIndex_3, index=code_block_8.out1, lacing=Longest)
code_block_12 = CodeBlock(x=getItemAtIndex_5) { x*-1000000; }
byOrigin = CoordinateSystem.ByOrigin(x=code_block_11, y=code_block_12)
transform = Geometry.Transform(geometry=byCoordinates, cs=byOrigin, lacing=Longest)
byPoints = Polygon.ByPoints(points=transform)
ZAxis = Vector.ZAxis()
code_block_13 = CodeBlock { 50; 100; 2; }
count = List.Count(list=byPoints)
asIntegers = Custom[RandomList.AsIntegers](min=code_block_13.out0, max=code_block_13.out1, amount=count, seed=code_block_13.out2)  # Creates a list of random integers between 0 and a given maximum value
extrudeAsSolid = Curve.ExtrudeAsSolid(curve=byPoints, direction=ZAxis, distance=asIntegers)
code_block_14 = CodeBlock { 100; }
scale = Geometry.Scale(geometry=extrudeAsSolid, xamount=code_block_14, yamount=code_block_14, zamount=code_block_14)
byGeometry = ImportInstance.ByGeometry(geometry=scale)
