# Dynamo graph ClashIDtoMark.dyn (Dynamo 2.0.3.8810)

categories = Categories(index=230)
all_elements_of_category = ElementsOfCategory(Category=categories)
code_block = CodeBlock { "Mark"; }
type = archilab.Revit.Elements.Elements.Type(element=all_elements_of_category)
name = Family.Name(family=type)
code_block_2 = CodeBlock { " VS "; }
split = String.Split(str=name, separater0=code_block_2)
code_block_3 = CodeBlock { 0; 1; }
getItemAtIndex = List.GetItemAtIndex(list=split@L2, index=code_block_3.out0)
substring = String.Substring(str=getItemAtIndex, startIndex=code_block_3.out0, length=code_block_3.out1)
getItemAtIndex_2 = List.GetItemAtIndex(list=split, index=code_block_3.out1, lacing=Longest)
substring_2 = String.Substring(str=getItemAtIndex_2, startIndex=code_block_3.out0, length=code_block_3.out1)
code_block_4 = CodeBlock { "Clash ID"; }
getParameterValueByName = Element.GetParameterValueByName(element=all_elements_of_category, parameterName=code_block_4)
python_script = Python(IN[0]=substring, IN[1]=substring_2, IN[2]=getParameterValueByName)
# ---------- python_script.python (21 lines) ----------
# Enable Python support and load DesignScript library
import clr
clr.AddReference('ProtoGeometry')
from Autodesk.DesignScript.Geometry import *

# The inputs to this node will be stored as a list in the IN variables.
dataEnteringNode = IN

firstDiscipline = IN[0]
secondDiscipline = IN[1]
clashNum = IN[2]
output = []

for i in range(len(firstDiscipline)):
	clashCat = firstDiscipline[i] + secondDiscipline[i]
	output.append(clashCat+"-"+clashNum[i])

# Place your code below this line

# Assign your output to the OUT variable.
OUT = output
# ----------------------------------------
setParameterByName = Element.SetParameterByName(element=all_elements_of_category, parameterName=code_block, value=python_script)
