# Dynamo graph ClosestGridandLevel.dyn (Dynamo 2.0.3.8810)

select_model_elements = DSModelElementsSelection()  # 5 picked in the model
string = StringInput("Clash Location")  # graph input
getLocation = Element.GetLocation(element=select_model_elements)
Z = Point.Z(point=getLocation)
categories = Categories(index=233)  # graph input
all_elements_of_category = ElementsOfCategory(Category=categories)
curve = Grid.Curve(grid=all_elements_of_category)
direction = Line.Direction(line=curve)
firstItem = List.FirstItem(list=direction)
isParallel = Vector.IsParallel(vector=direction, other=firstItem)
groupByKey = List.GroupByKey(list=all_elements_of_category, keys=isParallel)
string_2 = StringInput("Name")  # graph input
getParameterValueByName = Element.GetParameterValueByName(element=groupByKey.groups, parameterName=string_2)
lastItem = List.LastItem(list=getParameterValueByName)
firstItem_2 = List.FirstItem(list=getParameterValueByName)
code_block = CodeBlock(a=lastItem, b=firstItem_2) { Transpose(a+"-"+b<1>); }
groupByKey_2 = List.GroupByKey(list=curve, keys=isParallel)
lastItem_2 = List.LastItem(list=groupByKey_2.groups)
firstItem_3 = List.FirstItem(list=groupByKey_2.groups)
doesIntersect = Geometry.DoesIntersect(geometry=lastItem_2, other=firstItem_3, lacing=CrossProduct)
filterByBoolMask = List.FilterByBoolMask(list=code_block, mask=doesIntersect)
flatten = List.Flatten(list=filterByBoolMask.in)
location = FamilyInstance.Location(familyInstance=select_model_elements)
intersect = Geometry.Intersect(geometry=lastItem_2, other=firstItem_3, lacing=CrossProduct)
flatten_2 = List.Flatten(list=intersect)
distanceTo = Geometry.DistanceTo(geometry=location@L1, other=flatten_2)
sortByKey = List.SortByKey(list=flatten, keys=distanceTo@L2)
firstItem_4 = List.FirstItem(list=sortByKey.sorted_list, lacing=Longest)
python_script = Python(IN[0]=Z, IN[1]=firstItem_4)
# ---------- python_script.python (27 lines) ----------
# Enable Python support and load DesignScript library
import clr
clr.AddReference('ProtoGeometry')
from Autodesk.DesignScript.Geometry import *

# The inputs to this node will be stored as a list in the IN variables.
dataEnteringNode = IN

heights = IN[0]
grids = IN[1]

gridLocation = []
# Place your code below this line

for i, height in enumerate(heights):
	if 0<= height < 3300:
		level = "L00"
	elif 3300<= height < 6600:
		level = "L01"
	elif 6600<= height < 9764:
		level = "L02"
	else:
		level = "ROOF PLANT"
	gridLocation.append(grids[i] + " : " + level)

# Assign your output to the OUT variable.
OUT = gridLocation
# ----------------------------------------
setParameterByName = Element.SetParameterByName(element=select_model_elements, parameterName=string, value=python_script)
family_types = FamilyTypes(index=61)  # graph input
all_elements_of_family_type = ElementsOfFamilyType(Family_Type=family_types)
