# Dynamo graph SM_CLUSTER__TAGGER.dyn (Dynamo 2.0.3.8810)

tag_distribution_vertical = BoolSelector(true)  # graph input
select_model_elements = DSModelElementsSelection()  # 26 picked in the model; graph input
getLocation = Element.GetLocation(element=select_model_elements)

# group: c
clustering_factor = DoubleInput(500)  # graph input

# group: MAGIC CLUSTER
python_script = Python(IN[0]=getLocation, IN[1]=clustering_factor)
# ---------- python_script.python (27 lines) ----------
import clr
clr.AddReference('ProtoGeometry')
from Autodesk.DesignScript.Geometry import *

all_points = IN[0]
threshold = IN[1]

def groupPoints(point_list,ignore_distance): 
    grouped_points = [] #A list  that contains point groups
    queue = set() #A queue set (contains only unique items)
    while point_list: 
	    point_group = [] #A list that contains points that are within the ignore_distance
	    queue.add(point_list.pop()) # Move the last point from the point_list to our queue 
	    while queue:
		    current_point = queue.pop() #Get the last item in the queue and remove it from the queue.
		    point_group.append(current_point) #Add the current point to the point_group
		    for potential_match in point_list: 
			    distance = current_point.DistanceTo(potential_match) 
			    if distance <= ignore_distance:
				    queue.add(potential_match) 
		    point_list = [item for item in point_list if item not in queue] #removes points in queue from point_list

	    grouped_points.append(point_group)

    return grouped_points 

OUT = [groupPoints(all_points, threshold)]
# ----------------------------------------

# group: SORTING SPHERES TO MATCH CLUSTER LIST LAYOUT
Y = Point.Y()  # unwired: point
sortByFunction = List.SortByFunction(list=python_script@L2, func=Y)
flatten = List.Flatten(list=sortByFunction)
indexOf = List.IndexOf(list=flatten, element=getLocation)
sortByKey = List.SortByKey(list=select_model_elements, keys=indexOf)

tag_distance_from_sphere = DoubleInput(-3000)  # graph input

# group: ALIGNING CLUSTER POINTS TO MAX X
XAxis = Vector.XAxis()
translate = Geometry.Translate(geometry=sortByFunction, direction=XAxis, distance=tag_distance_from_sphere)
X = Point.X(point=translate)
maximumItem = List.MaximumItem(list=X, lacing=Longest)
Y_2 = Point.Y(point=translate)
Z = Point.Z(point=translate)
byCoordinates = Point.ByCoordinates(x=maximumItem@L1, y=Y_2@L2, z=Z@@L2)

distance_between_tags = DoubleInput(400)  # graph input

# group: ARRAYING TAGS
count = List.Count(list=byCoordinates@L2)
code_block = CodeBlock(x=count) { x==1; }
filterByBoolMask = List.FilterByBoolMask(list=byCoordinates@L3, mask=code_block@L2, lacing=Longest)
code_block_2 = CodeBlock(p=filterByBoolMask.out) { p.X; }
flatten_2 = List.Flatten(list=code_block_2)
code_block_3 = CodeBlock(p=filterByBoolMask.out) { p.Y; }
code_block_4 = CodeBlock(t2=code_block_3) { t1 = Math.Sum(t2); t3 = List.Count(t2@L2<1L>); t4 = t1@L2<1> / t3; }
flatten_3 = List.Flatten(list=code_block_4.t4)
count_2 = List.Count(list=code_block_3@L2)
python_script_2 = Python(IN[0]=flatten_3, IN[1]=count_2, IN[2]=distance_between_tags)
# ---------- python_script_2.python (37 lines) ----------
# Enable Python support and load DesignScript library
import clr
#clr.AddReference('ProtoGeometry')
clr.AddReferenceToFileAndPath(r'C:\Program Files\Dynamo\Dynamo Core\2\ProtoGeometry.dll')
from Autodesk.DesignScript.Geometry import *
clr.AddReference('DSCoreNodes')
from DSCore import Math as Math

# The inputs to this node will be stored as a list in the IN variables.
dataEnteringNode = IN

yNull = IN[0]
size = IN[1]
distance = IN[2]

outPoints = []

# Place your code below this line


for j in range(len(size)):
    sizeSide = size[j]/2.0
    pointsAxis = []
    sizeFloor = Math.Floor(sizeSide)

    if Math.DivRem(size[j],2) > 0:
        for i in range(1,sizeFloor+1):
            pointsAxis.append(yNull[j]+i*distance)
            pointsAxis.append(yNull[j]-i*distance)
        pointsAxis.append(yNull[j])
    else:
        for i in range(0,sizeFloor):
            pointsAxis.append(yNull[j]-distance/2-i*distance)
            pointsAxis.append(yNull[j]+distance/2+i*distance)
    outPoints.append(pointsAxis)
# Assign your output to the OUT variable.
OUT = outPoints
# ----------------------------------------
sort = List.Sort(list=python_script_2, lacing=Longest)
flatten_4 = List.Flatten(list=sort)
code_block_5 = CodeBlock(p=filterByBoolMask.out) { p.Z; }
flatten_5 = List.Flatten(list=code_block_5)
byCoordinates_2 = Point.ByCoordinates(x=flatten_2, y=flatten_4, z=flatten_5)
addItemToEnd = List.AddItemToEnd(item=filterByBoolMask.in, list=byCoordinates_2)

list_create = List.Create(item0=sortByKey.sorted_list, item1=addItemToEnd)

# group: SORTING SPHERES TO MATCH CLUSTER LIST LAYOUT
X_2 = Point.X()  # unwired: point
sortByFunction_2 = List.SortByFunction(list=python_script@L2, func=X_2)
flatten_6 = List.Flatten(list=sortByFunction_2)
indexOf_2 = List.IndexOf(list=flatten_6, element=getLocation)
sortByKey_2 = List.SortByKey(list=select_model_elements, keys=indexOf_2)

# group: ALIGNING CLUSTER POINTS TO MAX Y
YAxis = Vector.YAxis()
translate_2 = Geometry.Translate(geometry=sortByFunction_2, direction=YAxis, distance=tag_distance_from_sphere)
X_3 = Point.X(point=translate_2)
Y_3 = Point.Y(point=translate_2)
maximumItem_2 = List.MaximumItem(list=Y_3)
Z_2 = Point.Z(point=translate_2)
byCoordinates_3 = Point.ByCoordinates(x=X_3@L2, y=maximumItem_2@L1, z=Z_2@L2)

# group: ARRAYING TAGS
count_3 = List.Count(list=byCoordinates_3@L2)
code_block_6 = CodeBlock(x=count_3) { x==1; }
filterByBoolMask_2 = List.FilterByBoolMask(list=byCoordinates_3@L3, mask=code_block_6@L2, lacing=Longest)
flatten_7 = List.Flatten(list=filterByBoolMask_2.in)
code_block_7 = CodeBlock(p=filterByBoolMask_2.out) { p.X; }
code_block_8 = CodeBlock(t2=code_block_7) { t1 = Math.Sum(t2); t3 = List.Count(t2@L2<1L>); t4 = t1@L2<1> / t3; }
flatten_8 = List.Flatten(list=code_block_8.t4)
count_4 = List.Count(list=code_block_7@L2, lacing=Longest)
python_script_3 = Python(IN[0]=flatten_8, IN[1]=count_4, IN[2]=distance_between_tags)  # same code as python_script_2
sort_2 = List.Sort(list=python_script_3, lacing=Longest)
flatten_9 = List.Flatten(list=sort_2)
code_block_9 = CodeBlock(p=filterByBoolMask_2.out) { p.Y; }
flatten_10 = List.Flatten(list=code_block_9)
code_block_10 = CodeBlock(p=filterByBoolMask_2.out) { p.Z; }
flatten_11 = List.Flatten(list=code_block_10)
byCoordinates_4 = Point.ByCoordinates(x=flatten_9, y=flatten_10, z=flatten_11)
addItemToEnd_2 = List.AddItemToEnd(item=flatten_7, list=byCoordinates_4)

list_create_2 = List.Create(item0=sortByKey_2.sorted_list, item1=addItemToEnd_2)

# group: SCOPING IF TAGS VERTICAL OR HORIZONTAL
scopeIf = Custom[ScopeIf+](test=tag_distribution_vertical, true_var=list_create, false_var=list_create_2)  # A (hopefully) more robust implementation of ScopeIf. Tests a single boolean and returns a value accordingly.
code_block_11 = CodeBlock { 0; 1; }
getItemAtIndex = List.GetItemAtIndex(list=scopeIf, index=code_block_11.out0)
getItemAtIndex_2 = List.GetItemAtIndex(list=scopeIf, index=code_block_11.out1)

# group: PLACING TAGS
current = Document.Current()
activeView = Document.ActiveView(document=current)
boolean = BoolSelector(true)
byElementAndLocation = Tag.ByElementAndLocation(view=activeView, element=getItemAtIndex, location=getItemAtIndex_2, horizontal=tag_distribution_vertical, addLeader=boolean)  # graph output
tag_setlocation = Custom[Tag SetLocation](tag=byElementAndLocation, location=getItemAtIndex_2)  # Moves the head of the tag to the given location point.
