# Dynamo graph SM_EXCEL EXPORTER.dyn (Dynamo 2.0.3.8810)

file_path = Filename("..\5.Final Documents\045_TA_PF_FINAL SCHEDULE_EXCEL_REV A.xlsx")
categories = Categories(index=230)
all_elements_of_category = ElementsOfCategory(Category=categories)
code_block = CodeBlock()
# ---------- code_block.designscript (12 lines) ----------
["Type",
"Mark",
"Clash Location",
"Element 2 System Type",
"Element 2 Category",
"Element 2 Material",
"Element 2 Size",
"Element 1 Type",
"Element 1 Substrate Type",
"Element 1 Thickness",
"Element 1 Assembly",
"Element 1 Required FFR"];
# ----------------------------------------
getParameterValueByName = Element.GetParameterValueByName(element=all_elements_of_category, parameterName=code_block@L1)
transpose = List.Transpose(lists=getParameterValueByName)
restOfItems = List.RestOfItems(list=transpose, lacing=Longest)
firstItem = List.FirstItem(list=transpose, lacing=Longest)
name = FamilyType.Name(familyType=firstItem)
groupByKey = List.GroupByKey(list=restOfItems, keys=name)
code_block_2 = CodeBlock { 7; 0; }
boolean = BoolSelector(true)
exportExcel = Data.ExportExcel(filePath=file_path, sheetName=groupByKey.unique_keys, startRow=code_block_2.out0, startCol=code_block_2.out1, data=groupByKey.groups@L4, overWrite=boolean)
code_block_3 = CodeBlock { 10; }
takeItems = List.TakeItems(list=groupByKey.groups, amount=code_block_3, lacing=Longest)
