# Dynamo graph SM_PASSF DYN.dyn (Dynamo 2.0.3.8810)

# group: SHARED PARAMETERS CREATION
code_block = CodeBlock { "Element 2 Category"; }
code_block_2 = CodeBlock()
# ---------- code_block_2.designscript (4 lines) ----------
["Clash Category",
"Clash Point",
"Element 1 Level",
"Element 1 Base Constraint"];
# ----------------------------------------
# note: CREATES SHARED PARAMETERS FROM EXCEL COLUMN HEADERS
removeKeys = DesignScript.Builtin.Dictionary.RemoveKeys(keys=code_block_2)  # unwired: dictionary
code_block_3 = CodeBlock(x=removeKeys) { x[0].Keys; }  # frozen
addItemToEnd = List.AddItemToEnd(item=code_block, list=code_block_3)
code_block_4 = CodeBlock { "Clash Sphere"; }
parameter_types = ParameterTypeUi(index=124)
parameter_groups = ParameterGroupUi(index=105)
boolean = BoolSelector(true)
categories = Categories(index=230)
createSharedParameter = Parameter.CreateSharedParameter(parameterName=addItemToEnd, groupName=code_block_4, type=parameter_types, group=parameter_groups, instance=boolean, categoryList=categories, lacing=Longest)

# group: USER INPUT - CLASH SPHERE FAMILY
family_types = FamilyTypes(index=51)

# group: USER INPUT - EXCEL FILE PATH
# note: ONE BY ONE
string = StringInput("R:\Construction\01 Construction Projects\045 - Te Awa\03.0 Stage RMB\3.1.1 Commercial Drawings & Specs\Passive Fire\2.Navisworks\Reports - HTML_Excel\045_TA_Report_Mechanical.xlsx")  # graph input

# group: READ EXCEL AND CREATE DICTIONARY
# note: Script Name: SM_PASSF DYN.dyn
# Packages used in this script:
# Clockwork for Dynamo 2.x version: 2.1.2
# spring nodes version: 132.2.8
# TimeStamp : 2021/7/21 16:5
fromPath = FileObject(path=string)  # "File.FromPath"
code_block_5 = CodeBlock { "CLASH RESULTS"; true; false; }
importExcel = Data.ImportExcel(file=fromPath, sheetName=code_block_5.out0, readAsStrings=code_block_5.out1, showExcel=code_block_5.out2)
deconstruct = List.Deconstruct(list=importExcel)
byKeysValues = DesignScript.Builtin.Dictionary.ByKeysValues(keys=deconstruct.first, values=deconstruct.rest@L2)

watch = Watch(byKeysValues)

# group: PLACING OF SPHERE TO COORDINATES
code_block_6 = CodeBlock { "Clash Point"; }
valueAtKey = DesignScript.Builtin.Dictionary.ValueAtKey(dictionary=watch, key=code_block_6, lacing=Longest)
code_block_7 = CodeBlock { ","; ":"; }
split = String.Split(str=valueAtKey, separater0=code_block_7.out0, separater1=code_block_7.out1)
code_block_8 = CodeBlock { 1; 3; 5; }
getItemAtIndex = List.GetItemAtIndex(list=split, index=code_block_8.out0, lacing=Longest)
toNumber = String.ToNumber(str=getItemAtIndex)
code_block_9 = CodeBlock(x=toNumber) { x*1000; }
getItemAtIndex_2 = List.GetItemAtIndex(list=split, index=code_block_8.out1, lacing=Longest)
toNumber_2 = String.ToNumber(str=getItemAtIndex_2)
code_block_10 = CodeBlock(x=toNumber_2) { x*1000; }
getItemAtIndex_3 = List.GetItemAtIndex(list=split, index=code_block_8.out2, lacing=Longest)
toNumber_3 = String.ToNumber(str=getItemAtIndex_3)
code_block_11 = CodeBlock(x=toNumber_3) { x*1000; }
byCoordinates = Point.ByCoordinates(x=code_block_9, y=code_block_10, z=code_block_11)
byPoint = FamilyInstance.ByPoint(familyType=family_types@L1, point=byCoordinates)

# group: CREATING SCLASH SPHERE FAMILY TYPES
code_block_12 = CodeBlock { "Type"; }
code_block_13 = CodeBlock { "Clash Category"; }
valueAtKey_2 = DesignScript.Builtin.Dictionary.ValueAtKey(dictionary=watch, key=code_block_13, lacing=Longest)
uniqueItems = List.UniqueItems(list=valueAtKey_2)
duplicate = Custom[Springs.ElementType.Duplicate](elementType=family_types, newName=uniqueItems)  # Create duplicate element types. If the type exists, it will be appended instead.
name = Element.Name(element=duplicate, lacing=Longest)
allIndicesOf = List.AllIndicesOf(list=valueAtKey_2, item=uniqueItems@L2)
count = List.Count(list=allIndicesOf@L2)
ofRepeatedItem = List.OfRepeatedItem(item=name, amount=count, lacing=Longest)
byName = FamilyType.ByName(name=ofRepeatedItem)
setParameterByName = Element.SetParameterByName(element=byPoint@L1, parameterName=code_block_12, value=byName@L1)

# group: GRID LOCATION POPULATION FROM REVIT ELEMENT PARAMETERS
code_block_14 = CodeBlock { "Clash Location"; }
valueAtKey_3 = DesignScript.Builtin.Dictionary.ValueAtKey(dictionary=watch, key=code_block_14, lacing=Longest)
code_block_15 = CodeBlock { ":"; }
split_2 = String.Split(str=valueAtKey_3, separater0=code_block_15)
dropLastItem = Custom[List.DropLastItem](list=split_2, lacing=Longest)  # Drops the last item from a given list.
code_block_16 = CodeBlock { "Element 1 Level"; }
valueAtKey_4 = DesignScript.Builtin.Dictionary.ValueAtKey(dictionary=watch, key=code_block_16, lacing=Longest)
code_block_17 = CodeBlock { "Element 1 Base Constraint"; }
valueAtKey_5 = DesignScript.Builtin.Dictionary.ValueAtKey(dictionary=watch, key=code_block_17, lacing=Longest)
string_2 = StringInput("\"")
split_3 = String.Split(str=valueAtKey_5, separater0=string_2)
code_block_18 = CodeBlock { 1; }
getItemAtIndex_4 = List.GetItemAtIndex(list=split_3, index=code_block_18, lacing=Longest)
code_block_19 = CodeBlock { null; }
eq = _ == code_block_19  # unwired: x
replaceByCondition = Replace(item=valueAtKey_4, replaceWith=getItemAtIndex_4, condition=eq)
code_block_20 = CodeBlock(x=dropLastItem, y=replaceByCondition) { x+": " + y; }
setValueAtKeys = DesignScript.Builtin.Dictionary.SetValueAtKeys(dictionary=watch, keys=code_block_14, values=code_block_20, lacing=Longest)

removeKeys_2 = DesignScript.Builtin.Dictionary.RemoveKeys(dictionary=setValueAtKeys, keys=code_block_2)
keys = DesignScript.Builtin.Dictionary.Keys(dictionary=removeKeys_2)
values = DesignScript.Builtin.Dictionary.Values(dictionary=removeKeys_2)
string_3 = StringInput(" ")
# note: NULLS CREATE ERRORS
replaceNull = Custom[List.ReplaceNull](seq=values, replacement=string_3, lacing=Longest)  # Replaces all null values within a given list with a substitute
setParameterByName_2 = Element.SetParameterByName(element=setParameterByName@L1, parameterName=keys@L2, value=replaceNull@L2)
# note: OR ALL AT ONCE
string_4 = StringInput("R:\Construction\01 Construction Projects\045 - Te Awa\03.0 Stage RMB\3.1.1 Commercial Drawings & Specs\Passive Fire\2.Navisworks\Reports - HTML_Excel\045_TA_Report_Fire.xlsx")  # graph input

# group: READ EXCEL AND CREATE DICTIONARY
fromPath_2 = FileObject(path=string_4)  # "File.FromPath"
code_block_21 = CodeBlock { "CLASH RESULTS"; true; false; }
importExcel_2 = Data.ImportExcel(file=fromPath_2, sheetName=code_block_21.out0, readAsStrings=code_block_21.out1, showExcel=code_block_21.out2)

deconstruct_2 = List.Deconstruct(list=importExcel_2)
string_5 = StringInput("R:\Construction\01 Construction Projects\045 - Te Awa\03.0 Stage RMB\3.1.1 Commercial Drawings & Specs\Passive Fire\2.Navisworks\Reports - HTML_Excel\045_TA_Report_Hydraulic.xlsx")  # graph input

# group: READ EXCEL AND CREATE DICTIONARY
fromPath_3 = FileObject(path=string_5)  # "File.FromPath"
code_block_22 = CodeBlock { "CLASH RESULTS"; true; false; }
importExcel_3 = Data.ImportExcel(file=fromPath_3, sheetName=code_block_22.out0, readAsStrings=code_block_22.out1, showExcel=code_block_22.out2)

deconstruct_3 = List.Deconstruct(list=importExcel_3)
string_6 = StringInput("R:\Construction\01 Construction Projects\045 - Te Awa\03.0 Stage RMB\3.1.1 Commercial Drawings & Specs\Passive Fire\2.Navisworks\Reports - HTML_Excel\045_TA_Report_Electrical.xlsx")  # graph input

# group: READ EXCEL AND CREATE DICTIONARY
fromPath_4 = FileObject(path=string_6)  # "File.FromPath"
code_block_23 = CodeBlock { "CLASH RESULTS"; true; false; }
importExcel_4 = Data.ImportExcel(file=fromPath_4, sheetName=code_block_23.out0, readAsStrings=code_block_23.out1, showExcel=code_block_23.out2)

deconstruct_4 = List.Deconstruct(list=importExcel_4)
list_create = List.Create(item1=deconstruct_2.rest, item2=deconstruct_3.rest, item3=deconstruct_4.rest)  # unwired: item0
