# Dynamo graph SM_PLACE VIEWS.dyn (Dynamo 2.0.3.8810)

categories = Categories(index=447)
all_elements_of_category = ElementsOfCategory(Category=categories)
sheetName = Sheet.SheetName(sheet=all_elements_of_category)
categories_2 = Categories(index=602)
all_elements_of_category_2 = ElementsOfCategory(Category=categories_2)
clear_list = Custom[Clear List](Input=all_elements_of_category_2)  # This node will remove all Null and Empty Lists from any list.
name = Element.Name(element=clear_list)
contains = List.Contains(list=name, item=sheetName, lacing=CrossProduct)
anyTrue = Custom[Booleans.AnyTrue](seq=contains, lacing=Longest)  # Returns true if any item in a list of booleans is true.
filterByBoolMask = List.FilterByBoolMask(list=name, mask=anyTrue)
indexOf = List.IndexOf(list=sheetName, element=filterByBoolMask.in)
getItemAtIndex = List.GetItemAtIndex(list=all_elements_of_category, index=indexOf)
indexOf_2 = List.IndexOf(list=name, element=filterByBoolMask.in)
getItemAtIndex_2 = List.GetItemAtIndex(list=clear_list, index=indexOf_2)
categories_3 = Categories(index=586)
all_elements_of_category_3 = ElementsOfCategory(Category=categories_3)
getItemAtIndex_3 = List.GetItemAtIndex(list=all_elements_of_category_3, index=indexOf)
code_block = CodeBlock { "Sheet Width"; "Sheet Height"; }
getParameterValueByName = Element.GetParameterValueByName(element=getItemAtIndex_3, parameterName=code_block.out0)
code_block_2 = CodeBlock(x=getParameterValueByName) { x/2; }
getParameterValueByName_2 = Element.GetParameterValueByName(element=getItemAtIndex_3, parameterName=code_block.out1)
code_block_3 = CodeBlock(x=getParameterValueByName_2) { x/2; }
byCoordinates = Point.ByCoordinates(x=code_block_2, y=code_block_3)
create = Rhythm.Revit.Elements.Viewport.Create(sheet=getItemAtIndex, view=getItemAtIndex_2, location=byCoordinates)
