# Dynamo graph SM_SHEETS.dyn (Dynamo 2.0.3.8810)

string = StringInput("R:\Construction\01 Construction Projects\045 - Te Awa\03.0 Stage RMB\3.1.1 Commercial Drawings & Specs\Passive Fire\1.Revit\Sheets\045_TA_SHEET LIST.xlsx")
file_from_path = FileObject(path=string)
string_2 = StringInput("Sheet1")
code_block = CodeBlock { true; false; }
importExcel = Data.ImportExcel(file=file_from_path, sheetName=string_2, readAsStrings=code_block.out0, showExcel=code_block.out1)
deconstruct = List.Deconstruct(list=importExcel)

# group: CREATING SHEETS
family_types = FamilyTypes(index=1)  # frozen
count = List.Count(list=deconstruct.rest)
ofRepeatedItem = List.OfRepeatedItem(item=family_types, amount=count)
create = Rhythm.Revit.Elements.Sheet.Create(titleblock=ofRepeatedItem)
code_block_2 = CodeBlock { -3; }
dropItems = List.DropItems(list=deconstruct.first, amount=code_block_2)
dropItems_2 = List.DropItems(list=deconstruct.rest, amount=code_block_2, lacing=Longest)
setParameterByName = Element.SetParameterByName(element=create@L1, parameterName=dropItems@L2, value=dropItems_2@L2, lacing=Longest)

# group: CREATING VIEWS
string_3 = StringInput("CEILING")
contains = String.Contains(str=deconstruct.rest, searchFor=string_3)
anyTrue = Custom[Booleans.AnyTrue](seq=contains)  # Returns true if any item in a list of booleans is true.
filterByBoolMask = List.FilterByBoolMask(list=deconstruct.rest, mask=anyTrue)
code_block_3 = CodeBlock { 2; }
getItemAtIndex = List.GetItemAtIndex(list=filterByBoolMask.in, index=code_block_3, lacing=Longest)
getLevelByName = archilab.Revit.Selection.Select.GetLevelByName(name=getItemAtIndex)
byLevel = CeilingPlanView.ByLevel(level=getLevelByName)
code_block_4 = CodeBlock { ["View Name", "Scope Box"]; }
code_block_5 = CodeBlock { 1; }
getItemAtIndex_2 = List.GetItemAtIndex(list=filterByBoolMask.in, index=code_block_5, lacing=Longest)
categories = Categories(index=433)
all_elements_of_category = ElementsOfCategory(Category=categories)
name = Element.Name(element=all_elements_of_category)
code_block_6 = CodeBlock { 4; }
getItemAtIndex_3 = List.GetItemAtIndex(list=filterByBoolMask.in, index=code_block_6, lacing=Longest)
indexOf = List.IndexOf(list=name@L2, element=getItemAtIndex_3, lacing=Longest)
getItemAtIndex_4 = List.GetItemAtIndex(list=all_elements_of_category, index=indexOf)
list_create = List.Create(item0=getItemAtIndex_2, item1=getItemAtIndex_4)
setParameterByName_2 = Element.SetParameterByName(element=byLevel, parameterName=code_block_4@L1, value=list_create@L2)
code_block_7 = CodeBlock { 2; }
getItemAtIndex_5 = List.GetItemAtIndex(list=filterByBoolMask.out, index=code_block_7, lacing=Longest)
getLevelByName_2 = archilab.Revit.Selection.Select.GetLevelByName(name=getItemAtIndex_5)
byLevel_2 = FloorPlanView.ByLevel(level=getLevelByName_2)
code_block_8 = CodeBlock { ["View Name", "Scope Box"]; }
code_block_9 = CodeBlock { 1; }
getItemAtIndex_6 = List.GetItemAtIndex(list=filterByBoolMask.out, index=code_block_9, lacing=Longest)
categories_2 = Categories(index=433)
all_elements_of_category_2 = ElementsOfCategory(Category=categories_2)
name_2 = Element.Name(element=all_elements_of_category_2)
code_block_10 = CodeBlock { 4; }
getItemAtIndex_7 = List.GetItemAtIndex(list=filterByBoolMask.out, index=code_block_10, lacing=Longest)
indexOf_2 = List.IndexOf(list=name_2@L2, element=getItemAtIndex_7, lacing=Longest)
getItemAtIndex_8 = List.GetItemAtIndex(list=all_elements_of_category_2, index=indexOf_2)
list_create_2 = List.Create(item0=getItemAtIndex_6, item1=getItemAtIndex_8)
setParameterByName_3 = Element.SetParameterByName(element=byLevel_2, parameterName=code_block_8@L1, value=list_create_2@L2)
