# Dynamo graph SM_VIEW FILTERS.dyn (Dynamo 2.0.3.8810)

list_all_view_filters_in_current = Custom[List All View Filters in Current Document]()  # uses ParameterFilterElement type selection
name = Element.Name(element=list_all_view_filters_in_current)
code_block = CodeBlock { "PF"; }
startsWith = String.StartsWith(str=name, searchFor=code_block)
filterByBoolMask = List.FilterByBoolMask(list=list_all_view_filters_in_current, mask=startsWith)
watch = Watch(filterByBoolMask.in)
integer_slider = IntegerSlider(10, range=0..10 step 1)
getItemAtIndex = List.GetItemAtIndex(list=watch, index=integer_slider)
# note: Script Name: SM_VIEW FILTERS.dyn
# Creates and assignes View Filters to views which will hide Spheres from other Clash Tests
# Packages used in this script:
# Rhythm version: 2019.3.13
# Bakery version: 2018.4.301
# TimeStamp : 2021/4/13 14:43
categories = Categories(index=447)
all_elements_of_category = ElementsOfCategory(Category=categories)
viewports = archilab.Revit.Views.Sheets.Viewports(sheet=all_elements_of_category)
getView = Rhythm.Revit.Elements.Viewport.GetView(viewport=viewports)
code_block_2 = CodeBlock { 0; }
removeItemAtIndex = List.RemoveItemAtIndex(list=getView, indices=code_block_2)
flatten_list_and_replace_null = Custom[Flatten List and Replace Null with NULL VALUE](list=removeItemAtIndex)
filterByBoolMask_2 = List.FilterByBoolMask(list=name, mask=startsWith)
name_2 = Element.Name(element=all_elements_of_category)
removeItemAtIndex_2 = List.RemoveItemAtIndex(list=name_2, indices=code_block_2)
code_block_3 = CodeBlock { "_"; }
split = String.Split(str=removeItemAtIndex_2, separater0=code_block_3)
code_block_4 = CodeBlock { 2; }
takeItems = List.TakeItems(list=split, amount=code_block_4, lacing=Longest)
contains = String.Contains(str=filterByBoolMask_2.in, searchFor=takeItems, lacing=CrossProduct)
python_script = Python(IN[0]=contains)
# ---------- python_script.python (22 lines) ----------
# Enable Python support and load DesignScript library
import clr
clr.AddReference('ProtoGeometry')
from Autodesk.DesignScript.Geometry import *

# The inputs to this node will be stored as a list in the IN variables.
input = IN[0]

output = []
# Place your code below this line


for num,line in enumerate(IN[0], start=0):
	views = []
	for num1,line1 in enumerate(line, start=0):
		if line1[0]==True and line1[1]==True:
			views.append(num1)
	output.append(views)
			

# Assign your output to the OUT variable.
OUT = output
# ----------------------------------------
getItemAtIndex_2 = List.GetItemAtIndex(list=flatten_list_and_replace_null, index=python_script@L2)
getItemAtIndex_3 = List.GetItemAtIndex(list=getItemAtIndex_2, index=integer_slider)
code_block_5 = CodeBlock { false; }
add_view_filters_to_view = Custom[Add View Filters to View](viewFilterElements=getItemAtIndex, targetView=getItemAtIndex_3@L1, HideIfFalse=code_block_5)
removeFilter = archilab.Revit.Views.Views.RemoveFilter()  # unwired: view, viewFilter
addFilter = View.AddFilter()  # unwired: view, parameterFilter
