# Dynamo graph UserSphereParameterPopulator.dyn (Dynamo 2.0.3.8810)

family_types = FamilyTypes(index=70)
# note: Script Name: WIP_UserSphereParameterPopulator.dyn
# Packages used in this script:
# bimorphNodes version: 3.0.3
# Rhythm version: 2019.3.13
# Clockwork for Dynamo 2.x version: 2.1.2
# TimeStamp : 2021/4/12 19:0
all_elements_of_family_type = ElementsOfFamilyType(Family_Type=family_types)
select_model_elements = DSModelElementsSelection()  # 5 picked in the model
code_block = CodeBlock { "Element 1 Type"; }
getParameterValueByName = Element.GetParameterValueByName(element=select_model_elements, parameterName=code_block, lacing=Longest)
code_block_2 = CodeBlock(x=getParameterValueByName) { x==""; }
filterByBoolMask = List.FilterByBoolMask(list=select_model_elements, mask=code_block_2)
boundingBox = Element.BoundingBox(element=filterByBoolMask.in)
rhythm_Links = Links(index=2)
categories = Categories(index=604)
ofCategory = Revit.LinkElement.OfCategory(linkInstance=rhythm_Links, Category=categories)
code_block_3 = CodeBlock { "Req. Fire"; "Type"; }
getParameterValueByName_2 = Element.GetParameterValueByName(element=ofCategory, parameterName=code_block_3.out0, lacing=Longest)
isNull = Object.IsNull(obj=getParameterValueByName_2)
filterByBoolMask_2 = List.FilterByBoolMask(list=ofCategory, mask=isNull)
getElementsIntersect = Revit.BoundingBox.GetElementsIntersect(boundingBox=boundingBox, elements=filterByBoolMask_2.out)
isEmpty = List.IsEmpty(list=getElementsIntersect, lacing=Longest)
filterByBoolMask_3 = List.FilterByBoolMask(list=filterByBoolMask.in, mask=isEmpty)
code_block_4 = CodeBlock()
# ---------- code_block_4.designscript (4 lines) ----------
["Element 1 Type",
"Element 1 Assembly",
"Element 1 Substrate Type",
"Element 1 Required FFR"];
# ----------------------------------------
filterByBoolMask_4 = List.FilterByBoolMask(list=getElementsIntersect@L3, mask=isEmpty)
firstItem = List.FirstItem(list=filterByBoolMask_4.out@L2, lacing=Longest)
code_block_5 = CodeBlock { "Req. Fire"; "Type"; }
getParameterValueByName_3 = Element.GetParameterValueByName(element=firstItem, parameterName=code_block_5.out1, lacing=Longest)
name = WallType.Name(wallType=getParameterValueByName_3)
flatten = List.Flatten(list=name)
code_block_6 = CodeBlock { "Description"; "Wall Assembly Description"; }
getParameterValueByName_4 = Element.GetParameterValueByName(element=getParameterValueByName_3, parameterName=code_block_6.out1, lacing=Longest)
flatten_2 = List.Flatten(list=getParameterValueByName_4)
code_block_7 = CodeBlock { null; ""; }
replaceNull = Custom[Clockwork_List.ReplaceNull](seq=flatten_2, replacement=code_block_7.out1)  # Replaces all null values within a given list with a substitute
getParameterValueByName_5 = Element.GetParameterValueByName(element=getParameterValueByName_3, parameterName=code_block_6.out0, lacing=Longest)
flatten_3 = List.Flatten(list=getParameterValueByName_5)
getParameterValueByName_6 = Element.GetParameterValueByName(element=firstItem, parameterName=code_block_5.out0, lacing=Longest)
flatten_4 = List.Flatten(list=getParameterValueByName_6)
replaceNull_2 = Custom[Clockwork_List.ReplaceNull](seq=flatten_4, replacement=code_block_7.out1)
list_create = List.Create(item0=flatten, item1=replaceNull, item2=flatten_3, item3=replaceNull_2)
transpose = List.Transpose(lists=list_create)
setParameterByName = Element.SetParameterByName(element=filterByBoolMask_3.out@L1, parameterName=code_block_4@L2, value=transpose@L2, lacing=Longest)
countTrue = List.CountTrue(list=isEmpty)
countFalse = List.CountFalse(list=isEmpty)
