# Dynamo graph WIP_UserSphereParameterPopulator.dyn (Dynamo 2.0.3.8810)

# note: Script Name: WIP_UserSphereParameterPopulator.dyn
# Packages used in this script:
# bimorphNodes version: 3.0.3
# Rhythm version: 2019.3.13
# Clockwork for Dynamo 2.x version: 2.1.2
# TimeStamp : 2021/4/12 19:0
family_types = FamilyTypes(index=66)
all_elements_of_family_type = ElementsOfFamilyType(Family_Type=family_types)
boundingBox = Element.BoundingBox(element=all_elements_of_family_type)
rhythm_Links = Links(index=2)
categories = Categories(index=604)
ofCategory = Revit.LinkElement.OfCategory(linkInstance=rhythm_Links, Category=categories)
getElementsIntersect = Revit.BoundingBox.GetElementsIntersect(boundingBox=boundingBox, elements=ofCategory)
isEmpty = List.IsEmpty(list=getElementsIntersect, lacing=Longest)
filterByBoolMask = List.FilterByBoolMask(list=all_elements_of_family_type, mask=isEmpty)
code_block = CodeBlock()
# ---------- code_block.designscript (4 lines) ----------
["Element 1 Type",
"Element 1 Assembly",
"Element 1 Substrate Type",
"Element 1 Required FFR"];
# ----------------------------------------
filterByBoolMask_2 = List.FilterByBoolMask(list=getElementsIntersect@L3, mask=isEmpty)
firstItem = List.FirstItem(list=filterByBoolMask_2.out@L2, lacing=Longest)
code_block_2 = CodeBlock { "Req. Fire"; "Type"; }
getParameterValueByName = Element.GetParameterValueByName(element=firstItem, parameterName=code_block_2.out1, lacing=Longest)
name = WallType.Name(wallType=getParameterValueByName)
flatten = List.Flatten(list=name)
code_block_3 = CodeBlock { "Description"; "Wall Assembly Description"; }
getParameterValueByName_2 = Element.GetParameterValueByName(element=getParameterValueByName, parameterName=code_block_3.out1, lacing=Longest)
flatten_2 = List.Flatten(list=getParameterValueByName_2)
code_block_4 = CodeBlock { null; ""; }
replaceNull = Custom[Clockwork_List.ReplaceNull](seq=flatten_2, replacement=code_block_4.out1)  # Replaces all null values within a given list with a substitute
getParameterValueByName_3 = Element.GetParameterValueByName(element=getParameterValueByName, parameterName=code_block_3.out0, lacing=Longest)
flatten_3 = List.Flatten(list=getParameterValueByName_3)
getParameterValueByName_4 = Element.GetParameterValueByName(element=firstItem, parameterName=code_block_2.out0, lacing=Longest)
flatten_4 = List.Flatten(list=getParameterValueByName_4)
replaceNull_2 = Custom[Clockwork_List.ReplaceNull](seq=flatten_4, replacement=code_block_4.out1)
list_create = List.Create(item0=flatten, item1=replaceNull, item2=flatten_3, item3=replaceNull_2)
transpose = List.Transpose(lists=list_create)
setParameterByName = Element.SetParameterByName(element=filterByBoolMask.out@L1, parameterName=code_block@L2, value=transpose@L2, lacing=Longest)
countTrue = List.CountTrue(list=isEmpty)
countFalse = List.CountFalse(list=isEmpty)
