# Dynamo graph modifyViewrange.dyn (Dynamo 2.0.3.8810)

# group: Single view to modify
views = Views(index=10)  # graph input

# group: Find Views to modify view range
# note: Filter using your own methods to create a list of views that need to be modified.
element_types = ElementTypes(index=334)  # graph input
all_elements_of_type = ElementsOfType(element_type=element_types)
type = Object.Type(obj=all_elements_of_type)
# note: View range is automatically determined by associated level of the view, with offset determined by user input.
# For view depth, if bottom offset is below 0, view depth will be the same as offset. If above 0, set boolean to true if you want to follow bottom offset, false will keep view depth at 0.
code_block = CodeBlock { "Revit.Elements.Views.FloorPlanView"; }
eq = type == code_block
filterByBoolMask = List.FilterByBoolMask(list=all_elements_of_type, mask=eq)
name = Element.Name(element=filterByBoolMask.in)
code_block_2 = CodeBlock { "Level"; true; }
contains = String.Contains(str=name, searchFor=code_block_2.out0, ignoreCase=code_block_2.out1)
filterByBoolMask_2 = List.FilterByBoolMask(list=filterByBoolMask.in, mask=contains)

name_2 = Element.Name(element=filterByBoolMask_2.out)
code_block_3 = CodeBlock { "WALL"; }
contains_2 = String.Contains(str=name_2, searchFor=code_block_3)
filterByBoolMask_3 = List.FilterByBoolMask(list=filterByBoolMask_2.out, mask=contains_2)

# group: Offset
top_offset = CodeBlock { 3300; }
bottom_offset = CodeBlock { 0; }
cutoff_offset = CodeBlock { 1300; }
view_depth_offset = CodeBlock { 0; }

convert_between_units = DynamoConvert(top_offset, MeasurementType="Length", FromConversion="Millimeters", ToConversion="Feet")
convert_between_units_2 = DynamoConvert(bottom_offset, MeasurementType="Length", FromConversion="Millimeters", ToConversion="Feet")
convert_between_units_3 = DynamoConvert(cutoff_offset, MeasurementType="Length", FromConversion="Millimeters", ToConversion="Feet")
convert_between_units_4 = DynamoConvert(view_depth_offset, MeasurementType="Length", FromConversion="Millimeters", ToConversion="Feet")
python_modify_view_range = Python(IN[0]=filterByBoolMask_3.in, IN[1]=convert_between_units, IN[2]=convert_between_units_2, IN[3]=convert_between_units_3, IN[4]=convert_between_units_4)
# ---------- python_modify_view_range.python (42 lines) ----------
import clr
clr.AddReference('RevitAPI')
from Autodesk.Revit.DB import*
clr.AddReference('RevitServices')
from RevitServices.Persistence import DocumentManager
from RevitServices.Transactions import TransactionManager

def modViewrange(vp,tof,bof,cof,dof):
	v = UnwrapElement(vp)
	viewrange = v.GetViewRange()
	asslvl = v.GenLevel
	viewrange.SetLevelId(PlanViewPlane.TopClipPlane,asslvl.Id)
	viewrange.SetOffset(PlanViewPlane.TopClipPlane,tof)
	viewrange.SetLevelId(PlanViewPlane.BottomClipPlane,asslvl.Id)
	viewrange.SetOffset(PlanViewPlane.BottomClipPlane,bof)
	viewrange.SetOffset(PlanViewPlane.CutPlane,cof)
	viewrange.SetLevelId(PlanViewPlane.ViewDepthPlane,asslvl.Id)
	if bof < dof:
		viewrange.SetOffset(PlanViewPlane.ViewDepthPlane,bof)
	else:
		viewrange.SetOffset(PlanViewPlane.ViewDepthPlane,dof)
	#Applying the viewrange to the view
	v.SetViewRange(viewrange)

doc = DocumentManager.Instance.CurrentDBDocument
count = 0

TransactionManager.Instance.EnsureInTransaction(doc)
if isinstance(IN[0],list) and isinstance(IN[1],list):
	for vp,tof,bof,cof,dof in zip(IN[0],IN[1],IN[2],IN[3],IN[4]):
		modViewrange(vp,tof,bof,cof,dof)
		count += 1
elif isinstance(IN[0],list) and isinstance(IN[1],list) == False:
	for vp in IN[0]:
		modViewrange(vp,IN[1],IN[2],IN[3],IN[4])
		count += 1
else:
	modViewrange(IN[0],IN[1],IN[2],IN[3],IN[4])
	count += 1
TransactionManager.Instance.TransactionTaskDone()

OUT = '%d view ranges altered' %(count)
# ----------------------------------------
