# Dynamo graph PurgeUnusedLineStyles.dyn (Dynamo 1.3.4.6666)

python_script = Python()
# ---------- python_script.python (35 lines) ----------
import clr
clr.AddReference('ProtoGeometry')
from Autodesk.DesignScript.Geometry import *
clr.AddReference("RevitNodes")
import Revit
clr.ImportExtensions(Revit.Elements)
clr.ImportExtensions(Revit.GeometryConversion)
clr.AddReference("RevitServices")
import RevitServices
from RevitServices.Persistence import DocumentManager
from RevitServices.Transactions import TransactionManager
from System.Collections.Generic import *

clr.AddReference("RevitAPI")
import Autodesk
from Autodesk.Revit.DB import *
doc = DocumentManager.Instance.CurrentDBDocument
uiapp = DocumentManager.Instance.CurrentUIApplication
app = uiapp.Application
uidoc=DocumentManager.Instance.CurrentUIApplication.ActiveUIDocument

TransactionManager.Instance.EnsureInTransaction(doc)
lineStyle = doc.Settings.Categories.get_Item(BuiltInCategory.OST_Lines)
lineStyleSubTypes = lineStyle.SubCategories
listNames = []
listId = []

for i in lineStyleSubTypes:
  name = i.Name
  ID = i.Id
  listNames.append(name)
  listId.append(ID)

TransactionManager.Instance.TransactionTaskDone()
OUT = listNames, listId
# ----------------------------------------
number = DoubleInput(1)
getItemAtIndex = List.GetItemAtIndex(list=python_script, index=number)
categories = Categories("Lines")
all_elements_of_category = ElementsOfCategory(categories)
code_block = CodeBlock { "Line Style"; }
getParameterValueByName = Element.GetParameterValueByName(element=all_elements_of_category, parameterName=code_block)
uniqueItems = List.UniqueItems(getParameterValueByName)
name = Category.Name(uniqueItems)
number_2 = DoubleInput(0)
getItemAtIndex_2 = List.GetItemAtIndex(list=python_script, index=number_2)
string_from_object = FromObject(getItemAtIndex_2)
containsItem = List.ContainsItem(list=name, item=string_from_object)
filterByBoolMask = List.FilterByBoolMask(list=getItemAtIndex, mask=containsItem)
string_from_object_2 = FromObject(filterByBoolMask.out)
toNumber = String.ToNumber(string_from_object_2)
number_3 = DoubleInput(0)
lt = toNumber < number_3
filterByBoolMask_2 = List.FilterByBoolMask(list=toNumber, mask=lt)
python_script_2 = Python(IN[0]=filterByBoolMask_2.out)
# ---------- python_script_2.python (32 lines) ----------
import clr
clr.AddReference('ProtoGeometry')
from Autodesk.DesignScript.Geometry import *

clr.AddReference("RevitServices")
import RevitServices
from RevitServices.Persistence import DocumentManager
from RevitServices.Transactions import TransactionManager

clr.AddReference("RevitAPI")
import Autodesk
from Autodesk.Revit.DB import *
doc = DocumentManager.Instance.CurrentDBDocument
uiapp = DocumentManager.Instance.CurrentUIApplication
app = uiapp.Application

TransactionManager.Instance.EnsureInTransaction(doc)

from System.Collections.Generic import *

x = IN[0]
Erased = list()

for Id in x:
	elemId = Autodesk.Revit.DB.ElementId(Id)
	doc.Delete(elemId)
	Erased.append(Id)

	
TransactionManager.Instance.TransactionTaskDone()

OUT = Erased
# ----------------------------------------
