# Dynamo graph ReplaceDummyCallouts.dyn (Dynamo 1.3.4.6666)

# note: Date created: 16.07.2020
# Required nodes: Clockwork 1.32.0
# Created by: LM
# Description:
# This script will replace old Dummy Callout with the new smart Dummy Callout. It will place it in exact same spot, exact size, same referencing detail...
# IT WILL NOT REPLACE DUMMY CALLOUTS THAT ARE PLACED ON SHEETS, THESE HAVE TO BE REPLACED MANUALLY
# Instructions:
# 1. Load new Dummy Callout Circle Detail Item Family & it's Head tag.
# 2. Existing Dummy Callout Generic Annotation family has got a nested Head family within it, and we need to enable "Share" parameter of the Head to get its locations in project;
# To do this:
#  2.1 Edit Dummy Callout Generic Annotation  family
#  2.2 Edit Dummy Callout Head family
#  2.3 Enable "Share" parameter and load back  to Dummy Callout, no need to save
#  2.4. Load Dummy Callout back to project,  no need to save
# 3. Once old Dummy Callout has been edited and reloaded, run the script and wait some 5 mins
family_types = FamilyTypes("SM_Callout_Dummy_Head:SM_Callout_Dummy_Head")
all_elements_of_family_type = ElementsOfFamilyType(family_types)
superComponent = Custom[FamilyInstance.SuperComponent](familyInstance=all_elements_of_family_type)  # Retrieves the supercomponent of a given family instance
location = FamilyInstance.Location(superComponent)
python_script = Python(IN[0]=superComponent)
# ---------- python_script.python (21 lines) ----------
import clr

clr.AddReference("RevitServices")
import RevitServices
from RevitServices.Persistence import DocumentManager
doc =  DocumentManager.Instance.CurrentDBDocument

if isinstance(IN[0], list):
	tags = UnwrapElement(IN[0])
else:
	tags = [UnwrapElement(IN[0])]

listout = []

for x in tags:
	Id = x.OwnerViewId
	view = doc.GetElement(Id)
	listout.append(view)


OUT = listout
# ----------------------------------------
getCategory = Element.GetCategory(python_script)
id = Category.Id(getCategory)
categories = Categories("Sheets")
id_2 = Category.Id(categories)
eq = id == id_2
filterByBoolMask = List.FilterByBoolMask(list=location, mask=eq)
family_types_2 = FamilyTypes("SMG_Dummy Callout_Circle:SMG_Dummy Callout_Circle")
filterByBoolMask_2 = List.FilterByBoolMask(list=python_script, mask=eq)
byPointInView = Custom[FamilyInstance.ByPointInView](point=filterByBoolMask.out, familyType=family_types_2, view=filterByBoolMask_2.out, lacing=Longest)  # Places a family instance at a given point in a given view (e.g. a detail component).
code_block = CodeBlock { "Height"; "Width"; }
filterByBoolMask_3 = List.FilterByBoolMask(list=superComponent, mask=eq)
parameterByName = Parameter.ParameterByName(element=filterByBoolMask_3.out, name=code_block.out0)
value = Parameter.Value(parameterByName)
scale = Custom[View.Scale](view=filterByBoolMask_2.out)  # Returns the scale of a given view
mul = value * scale
setParameterByName = Element.SetParameterByName(element=byPointInView, parameterName=code_block.out0, value=mul)
parameterByName_2 = Parameter.ParameterByName(element=filterByBoolMask_3.out, name=code_block.out1)
value_2 = Parameter.Value(parameterByName_2)
mul_2 = value_2 * scale
setParameterByName_2 = Element.SetParameterByName(element=byPointInView, parameterName=code_block.out1, value=mul_2)
code_block_2 = CodeBlock { "Dummy Drawing Number"; "Dummy Sheet Ref"; }
code_block_3 = CodeBlock { "Drawing No"; "Sheet Ref"; }
parameterByName_3 = Parameter.ParameterByName(element=filterByBoolMask_3.out, name=code_block_3.out0)
value_3 = Parameter.Value(parameterByName_3)
setParameterByName_3 = Element.SetParameterByName(element=byPointInView, parameterName=code_block_2.out0, value=value_3)
parameterByName_4 = Parameter.ParameterByName(element=filterByBoolMask_3.out, name=code_block_3.out1)
value_4 = Parameter.Value(parameterByName_4)
setParameterByName_4 = Element.SetParameterByName(element=byPointInView, parameterName=code_block_2.out1, value=value_4)
boolean = BoolSelector(true)
horizontal_alignment_style = HorizontalAlignmentStyleUi("Right")
vertical_alignment_style = VerticalAlignmentStyleUi("Top")
byElement = Tag.ByElement(filterByBoolMask_2.out, byPointInView, boolean, boolean, horizontal_alignment_style, vertical_alignment_style)
filterByBoolMask_4 = List.FilterByBoolMask(list=all_elements_of_family_type, mask=eq)
location_2 = FamilyInstance.Location(filterByBoolMask_4.out)
setHeadPosition = Rhythm.Revit.Elements.Tag.SetHeadPosition(byElement, location_2)
