# Dynamo graph ReplaceDummySection.dyn (Dynamo 1.3.4.6666)

family_types = FamilyTypes("SM_Section placeholder:SM_Section placeholder")
all_elements_of_family_type = ElementsOfFamilyType(family_types)
subComponents = Custom[Element.SubComponents](element=all_elements_of_family_type)  # Retrieves all subcomponents of a given family instance
getLocation = Element.GetLocation(subComponents)
ownerView = Custom[Element.OwnerView](element=all_elements_of_family_type)  # Gets the owner view of a given Revit element (if possible)
string_from_object = FromObject(ownerView)
code_block = CodeBlock(x=string_from_object) { x!="Sheet"; }
filterByBoolMask = List.FilterByBoolMask(list=getLocation, mask=code_block)
filterByBoolMask_2 = List.FilterByBoolMask(list=ownerView, mask=code_block)
flatten = Flatten(filterByBoolMask_2.in)
plane = Custom[View.Plane](view=flatten)  # Retrieves the plane of a given view
origin = Plane.Origin(plane)
Z = Point.Z(origin)

# group: create line
code_block_2 = CodeBlock { 0; 1; }
getItemAtIndex = List.GetItemAtIndex(list=filterByBoolMask.in, index=code_block_2.out0, lacing=Longest)
X = Point.X(getItemAtIndex)
Y = Point.Y(getItemAtIndex)
byCoordinates = Point.ByCoordinates(x=X, y=Y, z=Z)
getItemAtIndex_2 = List.GetItemAtIndex(list=filterByBoolMask.in, index=code_block_2.out1, lacing=Longest)
X_2 = Point.X(getItemAtIndex_2)
Y_2 = Point.Y(getItemAtIndex_2)
byCoordinates_2 = Point.ByCoordinates(x=X_2, y=Y_2, z=Z)
byStartPointEndPoint = Line.ByStartPointEndPoint(startPoint=byCoordinates, endPoint=byCoordinates_2, lacing=Longest)

family_types_2 = FamilyTypes("SMG_Dummy Callout_Section:With Gap")
version = Custom[Application.Version]()  # Retrieves the name, version and build of the current Revit application.
python_script = Python(IN[0]=byStartPointEndPoint, IN[1]=family_types_2, IN[2]=flatten, IN[3]=version.Version)
# ---------- python_script.python (33 lines) ----------
import clr
clr.AddReference('RevitAPI')
from Autodesk.Revit.DB import *

clr.AddReference("RevitNodes")
import Revit
clr.ImportExtensions(Revit.Elements)
clr.ImportExtensions(Revit.GeometryConversion)

clr.AddReference("RevitServices")
import RevitServices
from RevitServices.Persistence import DocumentManager
from RevitServices.Transactions import TransactionManager

doc = DocumentManager.Instance.CurrentDBDocument
curves = UnwrapElement(IN[0])
famtype = UnwrapElement(IN[1])
view = UnwrapElement(IN[2])
version = IN[3]
elementlist = list()
counter = 0

TransactionManager.Instance.EnsureInTransaction(doc)
for i in range(len(curves)):
	if version > 2015:
		if not(famtype.IsActive): 
			famtype.Activate()
			doc.Regenerate()
	newobj = doc.Create.NewFamilyInstance.Overloads[Line, FamilySymbol, View](curves[i].ToRevitType(), famtype, view[i])
	#elementlist.append(newobj.ToDSType(False))
	elementlist.append(newobj)
TransactionManager.Instance.TransactionTaskDone()
OUT = elementlist
# ----------------------------------------
watch = Watch(python_script)
code_block_3 = CodeBlock { "Dummy Drawing Number"; "Dummy Sheet Ref"; }
filterByBoolMask_3 = List.FilterByBoolMask(list=all_elements_of_family_type, mask=code_block)
code_block_4 = CodeBlock { {"Detail #", "Sheet #"}; }
getParameterValueByName = Element.GetParameterValueByName(element=filterByBoolMask_3.in, parameterName=code_block_4, lacing=CrossProduct)
code_block_5 = CodeBlock { 0; 1; }
getItemAtIndex_3 = List.GetItemAtIndex(list=getParameterValueByName, index=code_block_5.out0, lacing=Longest)
setParameterByName = Element.SetParameterByName(element=watch, parameterName=code_block_3.out0, value=getItemAtIndex_3)
getItemAtIndex_4 = List.GetItemAtIndex(list=getParameterValueByName, index=code_block_5.out1, lacing=Longest)
setParameterByName_2 = Element.SetParameterByName(element=setParameterByName, parameterName=code_block_3.out1, value=getItemAtIndex_4)
