# Dynamo graph SectionBoxElementLinkFile.dyn (Dynamo 1.3.4.6666)

refresh = BoolSelector(false)
# note: Package: Springs  Node 132.2.8
selectLinkedElement = Custom[Springs.SelectLinkedElement](refresh=refresh)  # Select the linked instance first, followed by the element. If your selection fails, just press escape. To refresh the node, connect a boolean switch node.
python_script = Python(IN[0]=selectLinkedElement.element)
# ---------- python_script.python (21 lines) ----------
# Enable Python support and load DesignScript library
import clr
clr.AddReference('RevitAPI')
from Autodesk.Revit.DB import *
clr.AddReference('RevitServices')
import RevitServices
from RevitServices.Persistence import DocumentManager

# The inputs to this node will be stored as a list in the IN variables.
if isinstance(IN[0], list):
    elements = UnwrapElement(IN[0])
else:
    elements = [UnwrapElement(IN[0])]

docs = []
for elem in elements:
    doc = elem.Document
    docs.append(doc.Title)

# Assign your output to the OUT variable.
OUT = docs
# ----------------------------------------
output = Watch(python_script)
section_box_in_view = Views("{3D - Luka.MoricPS2C6}")
boundingBox = Element.BoundingBox(selectLinkedElement.element)
maxPoint = BoundingBox.MaxPoint(boundingBox)
X = Point.X(maxPoint)
minPoint = BoundingBox.MinPoint(boundingBox)
X_2 = Point.X(minPoint)
sub = X - X_2
scale = DoubleSlider(5, range=1..10 step 0.1)
code_block = CodeBlock(x=scale) { x*100; }
code_block_2 = CodeBlock(x=sub, y=code_block) { (x+y)/x; }
Y = Point.Y(maxPoint)
Y_2 = Point.Y(minPoint)
sub_2 = Y - Y_2
code_block_3 = CodeBlock(x=sub_2, y=code_block) { (x+y)/x; }
Z = Point.Z(maxPoint)
Z_2 = Point.Z(minPoint)
sub_3 = Z - Z_2
code_block_4 = CodeBlock(x=sub_3, y=code_block) { (x+y)/x; }
scale_2 = Custom[Springs.BoundingBox.Scale](boundingBox=boundingBox, xAmmount=code_block_2, yAmmount=code_block_3, zAmmount=code_block_4)  # Scales the bounding box in three dimensions according to it's center.
setSectionBox = Rhythm.Revit.Views.View3D.SetSectionBox(section_box_in_view, scale_2)
flatten = Flatten(setSectionBox)
activate_3d_view = BoolSelector(true)
python_script_2 = Python(IN[0]=flatten, IN[1]=activate_3d_view)
# ---------- python_script_2.python (25 lines) ----------
#Copyright 2016. All rights reserved. Bimorph Consultancy LTD, 5 St Johns Lane, London EC1M 4BH www.bimorph.co.uk
#Written by Thomas Mahon @Thomas__Mahon info@bimorph.co.uk Package: bimorphNodes
#GitHub: https://github.com/ThomasMahon/bimorphNodes/
#Follow: facebook.com/bimorphBIM | linkedin.com/company/bimorph-bim | @bimorphBIM

import clr

clr.AddReference("RevitServices")
import RevitServices
from RevitServices.Persistence import DocumentManager
from RevitServices.Transactions import TransactionManager

clr.AddReference("RevitAPI")
import Autodesk
from Autodesk.Revit.DB import *

doc = DocumentManager.Instance.CurrentDBDocument
uidoc = DocumentManager.Instance.CurrentUIDocument

TransactionManager.Instance.EnsureInTransaction(doc)
TransactionManager.Instance.ForceCloseTransaction()

view = UnwrapElement(IN[0])
if IN[1]:
	uidoc.RequestViewChange(view[0])
# ----------------------------------------
