# Dynamo graph Ultra Hatch.dyn (Dynamo 2.1.0.7500)

# group: INPUT
hatch_pattern_file_path_pat = Filename("..\..\new pattern.pat")  # graph input

# group: INPUT
settings_enter_in_brackets = StringInput("""Units (INCH/MM): [INCH]
Title: [name], [description]
Type (MODEL/DRAFTING): [MODEL]

Border Line Style: [Hidden Lines]
Slope Tolerance (1-50): [25]
Plot Corrected Lines (x): []""")  # graph input

code_block = CodeBlock(settings=settings_enter_in_brackets)
# ---------- code_block.designscript (4 lines) ----------
//Get Text in Brackets
split = String.Split(settings, ["]"]);
String.Remove(split, 0,
String.IndexOf(split, "[", false)+1);
# ----------------------------------------
code_block_2 = CodeBlock(input=code_block.out1)
# ---------- code_block_2.designscript (2 lines) ----------
//Get Pattern Units
List.GetItemAtIndex(input, 0);
# ----------------------------------------
code_block_3 = CodeBlock(input=code_block.out1)
# ---------- code_block_3.designscript (4 lines) ----------
//Get Pattern Title
"*"+
List.GetItemAtIndex(input, 1)+", "+
List.GetItemAtIndex(input, 2)+",";
# ----------------------------------------
string = StringInput(";%TYPE=")

# group: INPUT
drag_select_a_group_of_lines = DSModelElementsSelection()  # nothing selected; graph input

code_block_4 = CodeBlock(elements=drag_select_a_group_of_lines) { elements; }

# group: Get Lines
parameters = Element.Parameters(element=code_block_4)
string_from_object = FromObject(obj=parameters)
code_block_5 = CodeBlock(input=code_block.out1)
# ---------- code_block_5.designscript (3 lines) ----------
//Border Line Style
"Line Style : "+
List.GetItemAtIndex(input, 4);
# ----------------------------------------
contains = String.Contains(str=string_from_object, searchFor=code_block_5)
allFalse = List.AllFalse(list=contains@L2)
filterByBoolMask = List.FilterByBoolMask(list=code_block_4, mask=allFalse)
curves = Element.Curves(element=filterByBoolMask.in)
length = Curve.Length(curve=curves)

# group: Box Builder
curves_2 = Element.Curves(element=code_block_4)
code_block_6 = CodeBlock(curve=curves_2)
# ---------- code_block_6.designscript (30 lines) ----------
//Box Builder
//  The Bounds of the Hatch do not need to be a Square.
//  Now more patterns are possible.

allPoints =
List.Flatten([
Autodesk.Curve.StartPoint(curve),
Autodesk.Curve.EndPoint(curve)
],-1);

pointX = Point.X(allPoints);
pointY = Point.Y(allPoints);
minX = List.MinimumItem(pointX);
minY = List.MinimumItem(pointY);
maxX = List.MaximumItem(pointX);
maxY = List.MaximumItem(pointY);

//Pattern Origin
Point.ByCoordinates(minX,minY);

//Pattern Width/Scale
patternWidth =
maxX-minX;

//Pattern Height
patternHeight =
maxY-minY;

//Bounds Ratio
patternHeight/patternWidth;
# ----------------------------------------

code_block_7 = CodeBlock(input=code_block.out1)
# ---------- code_block_7.designscript (3 lines) ----------
//Slope Tolerance
String.ToNumber(
List.GetItemAtIndex(input, 5));
# ----------------------------------------

# group: Available Line Types Generator
code_block_8 = CodeBlock(boundsRatio=code_block_6.out10, tolerance=code_block_7)
# ---------- code_block_8.designscript (42 lines) ----------
//Available Line Types Generator
//This Node is Necessary to Prevent the occurrence of Diagonal Lines
//  with Irregular Slopes. If you plot a Line at just any Angle,
//  the Slope could be 1/854,239,645 and the Resulting Dash (to get
//  back to the same place on the grid) would be well over 1200 IN.
//  Line Families that exceed 1200 IN will not load!

riseSeq = (boundsRatio..#tolerance..boundsRatio);
rise = List.Flatten(List.OfRepeatedItem(riseSeq@L1<1>,tolerance),-1);
runSeq = (1..#tolerance..1);
run = List.Flatten(List.OfRepeatedItem(runSeq,tolerance),-1);
diagonal = Math.Round(Math.Sqrt(Math.Pow(rise,2)+Math.Pow(run,2)),7);
degrees = Math.Round(Math.Atan(rise/run),7);
ltIndex = List.FirstIndexOf(degrees,List.UniqueItems(degrees));

lineTypes =
List.Flatten([
[[0,0,1,1]],
List.Transpose([
List.GetItemAtIndex(degrees,ltIndex),
List.GetItemAtIndex(rise,ltIndex),
List.GetItemAtIndex(run,ltIndex),
List.GetItemAtIndex(diagonal,ltIndex)
]),
[[90,boundsRatio,0,boundsRatio]]
],1);

//Degrees
degreesSorted = List.Sort(degreesCleaned);
degreesCleaned = List.GetItemAtIndex(lineTypes@L2<1>, 0);
degreeIndex = List.AllIndicesOf(degreesCleaned,degreesSorted);

//Diagonal
List.GetItemAtIndex(
List.GetItemAtIndex(lineTypes@L2<1>, 3),
degreeIndex);

//X Origin Multiplier
List.GetItemAtIndex(Math.Max(
List.GetItemAtIndex(lineTypes@L2<1>, 1),
List.GetItemAtIndex(lineTypes@L2<1>, 2)
),degreeIndex);
# ----------------------------------------
string_from_object_2 = FromObject(obj=code_block_8.degreesSorted)
code_block_9 = CodeBlock(angles=string_from_object_2)
# ---------- code_block_9.designscript (7 lines) ----------
//Available Angles from X Axis
//  Any Diagonal Line will be
//  Corrected to one of these.
List.Count(angles)+
" Available Angles: "+
String.Join(", ",angles)+
" (from X Axis)";
# ----------------------------------------

# group: Correct Lines & Get Angle
code_block_10 = CodeBlock(originalCurves=curves)
# ---------- code_block_10.designscript (12 lines) ----------
//Original Line Direction
originalLineDir =
Line.Direction(originalCurves);

//Original Angle from X Axis
angleFromX =
Math.Round(
Vector.AngleWithVector(
Vector.XAxis(),
originalLineDir
),7);
originalCurves;
# ----------------------------------------
code_block_11 = CodeBlock(degreesSorted=code_block_8.degreesSorted, angleFromX=code_block_10.angleFromX)
# ---------- code_block_11.designscript (15 lines) ----------
//Corrected Index
List.IndexOf(mapped@L2<1>,
List.Chop(List.MinimumItem(mapped), 1)@L2<1>
);
mapped =
List.Chop(List.Flatten(
Math.Sqrt(Math.Pow(
originalAngleFromX<1> - degreesSorted<2>,
2))
),List.Count(degreesSorted));

originalAngleFromX =
angleFromX>90?
180-angleFromX:
angleFromX;
# ----------------------------------------
code_block_12 = CodeBlock(angleFromX=code_block_10.angleFromX, degreesSorted=code_block_8.degreesSorted, index=code_block_11.out0)
# ---------- code_block_12.designscript (8 lines) ----------
//Corrected Angle from X (0-180)
angleFromX > 90?
180-correctedAngleFromX:
correctedAngleFromX;

//Corrected Angle from X (0-90)
correctedAngleFromX =
List.GetItemAtIndex(degreesSorted,index);
# ----------------------------------------
code_block_13 = CodeBlock(angle=code_block_12.out0, angleFromX=code_block_10.angleFromX, lineDir=code_block_10.originalLineDir)
# ---------- code_block_13.designscript (11 lines) ----------
//Corrected Angle
correctedAngle =
negY?angle*-1:angle;

//Angle Rotation
correctedAngle-
Math.Round(
negY?angleFromX*-1:angleFromX,7);

//Check if Vector Y is Negative
negY = Vector.Y(lineDir) < 0;
# ----------------------------------------
code_block_14 = CodeBlock(originalCurves=code_block_10.originalCurves, length=length, rotation=code_block_13.out1)
# ---------- code_block_14.designscript (19 lines) ----------
//Corrected Start Points
Autodesk.Curve.StartPoint(correctedLines);

//Corrected Lines
correctedLines = Autodesk.Curve.ExtendStart(
Line.ByStartPointDirectionLength(
Autodesk.Curve.PointAtParameter(originalCurves,0.5),
correctedVector,
length/2),
length/2);

originalCurvesDir =
Line.Direction(originalCurves);

//Corrected Vector
//(for finding Delta X & Y)
correctedVector =
Vector.Rotate(originalCurvesDir,Vector.ZAxis(),
rotation);
# ----------------------------------------
code_block_15 = CodeBlock(correctedLines=code_block_14.correctedLines) { correctedLines; }

code_block_16 = CodeBlock(units=code_block_2) { units=="INCH"? 12: 1; }

# group: X Origin
code_block_17 = CodeBlock(patternSize=code_block_6.patternWidth, unitMult=code_block_16, origin=code_block_6.out7, startPoints=code_block_14.out0, mult=code_block_8.out12, index=code_block_11.out0)
# ---------- code_block_17.designscript (18 lines) ----------
//X Origin
//  A sequence is generated for each angle so that
//  a pattern with diagonal lines is not just
//  continuous allong the Y Axis.
xOrigin =
(start..#amount..patternSize);

Math.Round(xOrigin*unitMult,7);

start =
Geometry.DistanceTo(
Plane.ByOriginNormal(origin,Vector.XAxis()),
startPoints);

amount =
runLengths == 0?1:runLengths;

runLengths = List.GetItemAtIndex(mult, index);
# ----------------------------------------

# group: Y Origin
code_block_18 = CodeBlock(origin=code_block_6.out7, patternOrigin=code_block_14.out0, unitMult=code_block_16)
# ---------- code_block_18.designscript (7 lines) ----------
//Y Origin
yOrigin =
Geometry.DistanceTo(
Plane.ByOriginNormal(origin,Vector.YAxis()),
patternOrigin);

Math.Round(yOrigin*unitMult,7);
# ----------------------------------------

translate = Geometry.Translate(geometry=code_block_14.out0, yTranslation=code_block_6.patternHeight)

# group: Delta X
code_block_19 = CodeBlock(negY=code_block_13.negY, unitMult=code_block_16, origin=code_block_14.out0, normal=code_block_14.correctedVector, pointOffsetByY=translate)
# ---------- code_block_19.designscript (10 lines) ----------
//Delta X
deltaX =
negY?dX*-1:dX;

Math.Round(deltaX*unitMult,7);

dX =
Geometry.DistanceTo(
Plane.ByOriginNormal(origin,normal),
pointOffsetByY);
# ----------------------------------------

# group: Delta Y
code_block_20 = CodeBlock(angle=code_block_12.out0, unitMult=code_block_16, size=code_block_6.patternWidth, origin=code_block_14.out0, vector=code_block_14.correctedVector, pointOffsetByY=translate)
# ---------- code_block_20.designscript (14 lines) ----------
//Delta Y
deltaY =
angle>90?dYFixed*-1:dYFixed;

Math.Round(deltaY*unitMult,7);

dYFixed =
dY == 0?size:dY;

dY = Geometry.DistanceTo(
Plane.ByOriginNormal(
origin,
Vector.Rotate(vector,Vector.ZAxis(),90)
),pointOffsetByY);
# ----------------------------------------

# group: Segment Length
code_block_21 = CodeBlock(segmentLength=length, unitMult=code_block_16)
# ---------- code_block_21.designscript (4 lines) ----------
//Line
segmentLength;

Math.Round(segmentLength*unitMult,7);
# ----------------------------------------

# group: Dash Length
code_block_22 = CodeBlock(diagonal=code_block_8.out11, index=code_block_11.out0, box=code_block_6.patternWidth, segmentLength=length, unitMult=code_block_16)
# ---------- code_block_22.designscript (9 lines) ----------
//(-)Dash
dashLength =
(List.GetItemAtIndex(
diagonal,index)*box)-segmentLength;

String.Replace(
",-"+Math.Round(dashLength*unitMult,7),
",-0.000000",
"");
# ----------------------------------------

# group: Write to File
string_2 = StringInput("\n")
string_3 = StringInput("""
;%UNITS=INCH
;%VERSION=3.0
""")
string_4 = StringInput("""
;%UNITS=MM
;%VERSION=3.0
""")
code_block_23 = CodeBlock(units=code_block_2, inch=string_3, mm=string_4) { units=="INCH"? inch: mm; }
code_block_24 = CodeBlock(type=string, input=code_block.out1)
# ---------- code_block_24.designscript (3 lines) ----------
//Get Pattern Type
type+
List.GetItemAtIndex(input, 3);
# ----------------------------------------
code_block_25 = CodeBlock(direction=code_block_13.correctedAngle, xOrigin=code_block_17.out1, yOrigin=code_block_18.out1, DeltaX=code_block_19.out1, DeltaY=code_block_20.out1, SegmentLength=code_block_21.out1, DashLength=code_block_22.out1)
# ---------- code_block_25.designscript (8 lines) ----------
//Create Line Families
direction+",   "+
xOrigin+","+
yOrigin+",   "+
DeltaX+","+
DeltaY+",   "+
SegmentLength+
DashLength;
# ----------------------------------------
string_5 = StringInput("\n")

code_block_26 = CodeBlock(strL=code_block_25)
# ---------- code_block_26.designscript (3 lines) ----------
//Remove Trailing Zeros
String.Replace(
strL, ".000000", "");
# ----------------------------------------

# group (continued): Write to File
join = List.Join(list0=code_block_23, list1=code_block_3, list2=code_block_24, list3=code_block_26, list4=string_5)
flatten = List.Flatten(list=join)
code_block_27 = CodeBlock(sep=string_2, str=flatten)
# ---------- code_block_27.designscript (5 lines) ----------
String.Replace(
String.Join(sep,str),
".500000",
".5"
);
# ----------------------------------------
writeText = FileSystem.WriteText(filePath=hatch_pattern_file_path_pat, text=code_block_27)
pattern_text = Watch(code_block_27)  # graph output

# group: SLope Tolerance Results
string_6 = StringInput("\n")
code_block_28 = CodeBlock(segmentLength=code_block_21.segmentLength, dashLength=code_block_22.dashLength, units=code_block_2)
# ---------- code_block_28.designscript (12 lines) ----------
//Report Longest Line Family for Inches
longestLine>unitMax?
"WARNING! A line family exceeds "+unitMax+" "+measure+" ("+longestLine+" "+measure+"). This Pattern May Not Load, try a Lower Tolerance or Shrink your Sketch.":
"Longest Line Family: "+longestLine+" "+measure+" (Segment + Resulting Dash)";

longestLine = List.MaximumItem((
List.Flatten(segmentLength, -1)+
List.Flatten(dashLength, -1))*unitMult);

measure = units=="INCH"? "INCH": "MM";
unitMult = units=="INCH"? 12: 1;
unitMax = units=="INCH"? 1200: 30000;
# ----------------------------------------
code_block_29 = CodeBlock(angleO=code_block_10.angleFromX, angleC=code_block_12.out0)
# ---------- code_block_29.designscript (11 lines) ----------
//Listed Angles with Paired Corrections
String.Join("",List.Flatten(
[
["From ("+List.Count(List.UniqueItems(angleO))+") Different Angles: "],
[List.UniqueItems(String.Replace("("+angleO+","+angleC+")",".000000",""))],
["(original,corrected)"]
]
, -1));
"Largest Correction: "+
List.MaximumItem(List.Flatten(angleO-angleC,-1))+
" Degrees";
# ----------------------------------------
join_2 = String.Join(separator=string_6, string0=code_block_28.out0, string1=code_block_29.out0, string2=code_block_29.out1)
slope_tolerance_results = Watch(join_2)  # graph output

# group: INPUT
# note: Created By: dcmasten1
notes = StringInput("""   This Graph will Write a Hatch Pattern Text File for any set of Straight Lines.

   Drag Select over a group of Lines in a Plan or Drafting View. For patterns that have a lot of Blank Space, you have the option to add a Border.  Just type in the Line Style that you are using if one exists; it need not be Square.

   The Slope Tolerance governs the available Angle that Diagonal Lines will be corrected to. Feel free to Increase it, but if a line family exceeds 1200 IN or 30000 MM, the pattern will probably not load! Watch the Slope Tolerance Results to see if a Hatch Pattern cannot be Loaded.""")  # graph input

# group: Plot Corrected Lines
current = Document.Current()
activeView = Document.ActiveView(document=current)
code_block_30 = CodeBlock(view=activeView, input=code_block.out1)
# ---------- code_block_30.designscript (5 lines) ----------
List.GetItemAtIndex(
[view,List.Empty],
run == "x"? 0: 1);
run =
List.GetItemAtIndex(input, 6);
# ----------------------------------------
code_block_31 = CodeBlock(lines=code_block_15, width=code_block_6.patternWidth)
# ---------- code_block_31.designscript (3 lines) ----------
//Move Corrected Lines
Geometry.Translate(lines,
width+(width/2),0,0);
# ----------------------------------------
byCurve = DetailCurve.ByCurve(view=code_block_30.out0, curve=code_block_31)
