# Dynamo graph UpRev.dyn (Dynamo 1.3.4.6666)

# group: INFO
# note: PACKAGES REQUIRED:
# archi-lab.net    2018.13.13
# Data-Shapes   2018.12.1

file_path = Filename("R:\Standards\Revit\RDG Startup Files\Dynamo Player\Images\rdg_logo_color_process.png")
code_block = CodeBlock { "CANCEL"; 600; "PLACE REVISIONS ON SHEETS"; }
code_block_2 = CodeBlock { "Select Sheets"; "Select Revision"; }
boolean = BoolSelector(true)
get_all_revisions = Custom[Get All Revisions](RunIt=boolean)  # This node will return all Revisions currently defined in the mode.
name = Element.Name(get_all_revisions)
code_block_3 = CodeBlock { 1; }
boolean_2 = BoolSelector(true)
ui_dropdown_data = Custom[UI.DropDown Data](InputName=code_block_2.out1, Keys=name, Values=get_all_revisions, DefaultValueIndex=code_block_3, Sorted_optional=boolean_2)  # Create data for DropDown input in UI.MultiInputForm ++ . Check out www.data-shapes.net for more infos.
sheets = Python()  # unwired: IN[0]
# ---------- sheets.python (36 lines) ----------
#Copyright(c) 2017, john pierson
# @60secondrevit, http://sixtysecondrevit.com

import clr
clr.AddReference('ProtoGeometry')
from Autodesk.DesignScript.Geometry import *

# Import DocumentManager and TransactionManager
clr.AddReference("RevitServices")
import RevitServices
from RevitServices.Persistence import DocumentManager
from RevitServices.Transactions import TransactionManager

# Import RevitAPI
clr.AddReference("RevitAPI")
import Autodesk
from Autodesk.Revit.DB import *

doc = DocumentManager.Instance.CurrentDBDocument
uiapp = DocumentManager.Instance.CurrentUIApplication
app = uiapp.Application

from System.Collections.Generic import *


#The inputs to this node will be stored as a list in the IN variable.
dataEnteringNode = IN
collector = FilteredElementCollector(doc)
sheets= collector.OfCategory(BuiltInCategory.OST_Sheets).WhereElementIsNotElementType().ToElements()

sheet = []
for i in sheets:
	if not i.IsPlaceholder:
		sheet.append(i)

OUT = sheet
# ----------------------------------------
sheetNumber = Sheet.SheetNumber(sheets)
sheetName = Sheet.SheetName(sheets)
code_block_4 = CodeBlock(a=sheetNumber, b=sheetName) { a+" - "+b; }
code_block_5 = CodeBlock { 300; }
boolean_3 = BoolSelector(false)
ui_listview_data = Custom[UI.Listview Data](InputName=code_block_2.out0, Keys=code_block_4, Values=sheets, Height_optionnal=code_block_5, SortItems_optionnal=boolean_2, ShowId_optionnal=boolean_3)  # Create data for ListView input in UI.MultiInputForm ++ . Check out www.data-shapes.net for more infos.
create = List.Create(ui_dropdown_data, ui_listview_data)
boolean_4 = BoolSelector(true)
ui_multipleinputform = Custom[UI.MultipleInputForm ++](Logo_optional=file_path, ButtonText_optional=code_block.out2, Inputs=create, Toggle=boolean_4, CancelButtonText_optional=code_block.out0, Width_optional=code_block.out1)  # Create a form with multiple inputs. see www.data-shapes.net for tutorials and infos!
code_block_6 = CodeBlock(seq=ui_multipleinputform.User_Inputs) { seq[1]; {seq[0]}; }
watch = Watch(code_block_6.out0)
count = Count(code_block_6.out0)
cycle = List.Cycle(list=code_block_6.out1, amount=count)
boolean_5 = BoolSelector(true)
add_revisions_to_sheet = Custom[Add Revisions to Sheet](Sheet=watch, Revision=cycle, RunIt=boolean_5)  # This node will add specified revisions to a sheet.
