# Dynamo graph ViewTemplatesDeleteUnused.dyn (Dynamo 1.3.4.6666)

categories = Categories("Views")
all_elements_of_category = ElementsOfCategory(categories)
isApplied = Custom[ViewTemplate.IsApplied](ViewTemplate_s=all_elements_of_category)  # Returns a boolean value indicating wether a ViewTemplate is applied to any view in the project or not. This won't work for 3D templates.
