# Dynamo graph BatchUpRev-VER3.dyn (Dynamo 2.0.3.8810)

# group: PATHS OF RVT FILES NEEDING UPREVING
# note: CREATE AS MANY AS PATHS AS NEEDED AND EXTEND THE LIST
string = StringInput("path to rvt project")  # graph input
string_2 = StringInput("path to rvt project")  # graph input
string_3 = StringInput("path to rvt project")  # graph input
string_4 = StringInput("path to rvt project")  # graph input

list_create = List.Create(item0=string, item1=string_2, item2=string_3, item3=string_4)

# group: OPENING DOCUMENT
boolean = BoolSelector(false)
openDocumentFile = Rhythm.Revit.Application.Applications.OpenDocumentFile(filePath=list_create, audit=boolean, detachFromCentral=boolean)

# group: FOLDER WHERE TO SAVE PDF
# note: Script Name: BatchUpRev-VER3.dyn
# Packages used in this script:
# Rhythm version: 2019.3.13
# Clockwork for Dynamo 2.x version: 2.1.2
# Genius Loci version: 2021.7.30
# Summerset version: 1.0.0
# TimeStamp : 2021/9/27 16:51
string_5 = StringInput("path to output folder")  # graph input

code_block = CodeBlock { ["\\",".rvt"]; }
split = String.Split(str=list_create, separater0=code_block, lacing=Longest)
lastItem = List.LastItem(list=split, lacing=Longest)

# group: FILTER OUT PLACEHOLDER SHEETS
categories = Categories(index=447)
elementsOfCategoryInDocument = Rhythm.Revit.Selection.Collector.ElementsOfCategoryInDocument(document=openDocumentFile, category=categories)
sheetName = Sheet.SheetName(sheet=elementsOfCategoryInDocument)
code_block_2 = CodeBlock { "TYPICAL"; }
code_block_3 = CodeBlock { true; }
startsWith = String.StartsWith(str=sheetName, searchFor=code_block_2, ignoreCase=code_block_3)
filterByBoolMask = List.FilterByBoolMask(list=elementsOfCategoryInDocument, mask=startsWith)
watch = Watch(filterByBoolMask.out)

# group: REVISION DATA
revision_info = CodeBlock { "rev description"; "issued by"; "issued to"; "rev date"; }
string_6 = StringInput("Alphanumeric")
python_script = Python(IN[0]=string_6)
# ---------- python_script.python (15 lines) ----------
import clr
clr.AddReference('RevitAPI')
import Autodesk
from Autodesk.Revit.DB import *

# The inputs to this node will be stored as a list in the IN variables.
dataEnteringNode = IN
revType = IN[0]

if revType == "Alphanumeric":
	OUT = Autodesk.Revit.DB.RevisionNumberType.Alphanumeric
elif revType == "Numeric":
	OUT = Autodesk.Revit.DB.RevisionNumberType.Numeric
else:
	OUT = "Wrong selection"
# ----------------------------------------
string_7 = StringInput("Numeric")

# group: LOGIC IF REVISION EXISTS
element_types = ElementTypes(index=264)
elementsOfTypeInDocument = Rhythm.Revit.Selection.Collector.ElementsOfTypeInDocument(document=openDocumentFile, elementType=element_types)
code_block_4 = CodeBlock { "Revision Description"; "Revision Date"; }
getParameterValueByName = Element.GetParameterValueByName(element=elementsOfTypeInDocument, parameterName=code_block_4.out0)
eq = getParameterValueByName == revision_info.out0  # lacing=Longest
getParameterValueByName_2 = Element.GetParameterValueByName(element=elementsOfTypeInDocument, parameterName=code_block_4.out1)
eq_2 = getParameterValueByName_2 == revision_info.out3  # lacing=Longest
and_ = eq && eq_2  # lacing=Longest
anyTrue = Custom[Booleans.AnyTrue](seq=and_, lacing=Longest)  # Returns true if any item in a list of booleans is true.
not_ = Not(x=anyTrue)

clockwork_Passthrough = Custom[Clockwork_Passthrough](passThrough=revision_info.out0, waitFor=not_)  # Forces a sequential order of execution. The node wired into the output of the Passthrough node will be executed *after* the node wired into the waitFor input (e.g. important for some Revit operations). The value of the passThrough input will be passed on to the node wired into the output port of the Passthrough node.

# group: CREATE REV
python_script_2 = Python(IN[0]=openDocumentFile, IN[1]=clockwork_Passthrough, IN[2]=revision_info.out1, IN[3]=revision_info.out2, IN[4]=revision_info.out3, IN[5]=python_script, IN[6]=not_)
# ---------- python_script_2.python (76 lines) ----------
# Copyright(c) 2015, Konrad K Sobon
# @arch_laboratory, http://archi-lab.net

import clr
# Import Element wrapper extension methods
clr.AddReference("RevitNodes")
import Revit
clr.ImportExtensions(Revit.Elements)

# Import DocumentManager and TransactionManager
clr.AddReference("RevitServices")
import RevitServices
from RevitServices.Persistence import DocumentManager
from RevitServices.Transactions import TransactionManager


# Import RevitAPI
clr.AddReference("RevitAPI")
import Autodesk
from Autodesk.Revit.DB import *

import sys
pyt_path = r'C:\Program Files (x86)\IronPython 2.7\Lib'
sys.path.append(pyt_path)

import System
from System import Array
from System.Collections.Generic import *

#The inputs to this node will be stored as a list in the IN variable.
dataEnteringNode = IN

if isinstance(IN[0], list):
	docs = []
	for i in IN[0]:
		docs.append(UnwrapElement(i))
else:
	docs = [UnwrapElement(IN[0])]
	
description	= IN[1]
issuedBy= IN[2]
issuedTo= IN[3]
date= IN[4]
revType = IN[5]
RunIt = UnwrapElement(IN[6])

errorReport = []

try:
	revs = []
	for i, doc in enumerate(docs):
		if RunIt[i]:
			t = Transaction(doc,'temp')
			t.Start()
			newRevision = Revision.Create(doc)
			newRevision.Description = description
			newRevision.IssuedBy = issuedBy
			newRevision.IssuedTo = issuedTo
			newRevision.NumberType = revType
			newRevision.RevisionDate = date
			t.Commit()
			revs.append(newRevision)
		else:
			errorReport.append("Revision Exists")
except:
	# if error accurs anywhere in the process catch it
	import traceback
	errorReport.Add(traceback.format_exc())



#Assign your output to the OUT variable
if errorReport.count == 0:
	OUT = revs
else:
	OUT = errorReport
# ----------------------------------------

python_script_3 = Python()
# ---------- python_script_3.python (9 lines) ----------
import clr
clr.AddReference('RevitAPI')
import Autodesk
from Autodesk.Revit.DB import *

# The inputs to this node will be stored as a list in the IN variables.
dataEnteringNode = IN

OUT = Autodesk.Revit.DB.RevisionVisibility.Hidden
# ----------------------------------------

# group: ASSIGN REVS TO SHEETS
python_script_4 = Python(IN[0]=watch, IN[1]=python_script_2, IN[2]=not_, IN[3]=openDocumentFile, IN[4]=elementsOfTypeInDocument, IN[5]=python_script_3)
# ---------- python_script_4.python (75 lines) ----------
# Copyright(c) 2015, Konrad K Sobon
# @arch_laboratory, http://archi-lab.net

import clr
# Import Element wrapper extension methods
clr.AddReference("RevitNodes")
import Revit
clr.ImportExtensions(Revit.Elements)

# Import DocumentManager and TransactionManager
clr.AddReference("RevitServices")
import RevitServices
from RevitServices.Persistence import DocumentManager
from RevitServices.Transactions import TransactionManager


# Import RevitAPI
clr.AddReference("RevitAPI")
import Autodesk
from Autodesk.Revit.DB import *

import sys
pyt_path = r'C:\Program Files (x86)\IronPython 2.7\Lib'
sys.path.append(pyt_path)

import System
from System import Array
from System.Collections.Generic import *

#The inputs to this node will be stored as a list in the IN variable.
dataEnteringNode = IN

sheets = UnwrapElement(IN[0])
revs = UnwrapElement(IN[1])
RunIt = IN[2]
docs = IN[3]
revisions = UnwrapElement(IN[4])

vis = IN[5]

errorReport = []

try:
	for i,doc in enumerate(docs):
		for r in revisions[i]:
			tr = Transaction(doc,'hide')
			tr.Start()
			r.Visibility = vis
			tr.Commit()
		if RunIt[i]:
			for sheet in sheets[i]:
				revisionsOnSheet = sheet.GetAdditionalRevisionIds()
				if revs[i].Id not in revisionsOnSheet:
					revisionsOnSheet.Add(revs[i].Id)
				else:
					continue
				t = Transaction(doc,'temp')
				t.Start()

				sheet.SetAdditionalRevisionIds(revisionsOnSheet)
				t.Commit()
		else:
			errorReport.append("Revision Exists")
except:
	# if error accurs anywhere in the process catch it
	import traceback
	errorReport.append(traceback.format_exc())



#Assign your output to the OUT variable
if errorReport.count == 0:
	OUT = IN[0]
else:
	OUT = errorReport
# ----------------------------------------

clockwork_Passthrough_2 = Custom[Clockwork_Passthrough](passThrough=watch, waitFor=python_script_4)

# group: PDF FILE NAMING
sheetNumber = Sheet.SheetNumber(sheet=clockwork_Passthrough_2)
name = Element.Name(element=clockwork_Passthrough_2)
code_block_5 = CodeBlock(a=sheetNumber, b=name) { a +"-"+b+"-"; }
operators = lastItem + code_block_5
code_block_6 = CodeBlock { "/"; "-"; }
replace = String.Replace(str=operators, searchFor=code_block_6.out0, replaceWith=code_block_6.out1)

# group: PRINTING
geniusLoci_FilenameToFilePaths = Custom[GeniusLoci_FilenameToFilePaths](DirectoryPath=string_5, Filenames=replace)  # Add directory and .pdf extension to filenames. Be careful with forbidden characters in filenames (* . " / \ : ;) For use with the "Remove Special Characters from String" node.
code_block_7 = CodeBlock { "Default"; }
geniusloci_print_settings_byname = Custom[GeniusLoci_Print Settings ByName](printSettingsName=code_block_7, docOrRevitLinkInstance=openDocumentFile)  # Collect printsettings by given name in the active or given document.
code_block_8 = CodeBlock { "PDF-XChange Lite"; }
print_pdf = BoolSelector(true)  # graph input
smd_print_from_document = Custom[SMD_Print from Document](document=openDocumentFile, FilePaths=geniusLoci_FilenameToFilePaths, views=clockwork_Passthrough_2, PrintSetting=geniusloci_print_settings_byname, PrinterName=code_block_8, RunIt=print_pdf)  # Prints pdf from document without print margin (achieves this by creating custom print properties). Based on GeniousLoci node

clockwork_Passthrough_3 = Custom[Clockwork_Passthrough](passThrough=openDocumentFile, waitFor=smd_print_from_document)

# group: SAVING, SET TO FALSE IF SAVING IS NOT REQUIRED
boolean_2 = BoolSelector(true)
closeDocument = Rhythm.Revit.Application.Applications.CloseDocument(document=clockwork_Passthrough_3, save=boolean_2)

string_8 = StringInput("path to rvt project")  # graph input
list_sortnatural = Custom[List SortNatural](list=geniusLoci_FilenameToFilePaths, lacing=Longest)  # Sorts a specified list in natural order in either ascending or descending order.
clockwork_Passthrough_4 = Custom[Clockwork_Passthrough](passThrough=lastItem, waitFor=smd_print_from_document)
filenameToFilePaths = Custom[FilenameToFilePaths](DirectoryPath=string_5, Filenames=clockwork_Passthrough_4)  # Add directory and .pdf extension to filenames. Be careful with forbidden characters in filenames (* . " / \ : ;) For use with the "Remove Special Characters from String" node.
mergePDFs = Printing.Merge.MergePDFs(Filenames=list_sortnatural, TargetPdf=filenameToFilePaths)
code_block_9 = CodeBlock { true; }  # frozen
indexOf = List.IndexOf(list=and_, element=code_block_9, lacing=Longest)
getItemAtIndex = List.GetItemAtIndex(list=elementsOfTypeInDocument, index=indexOf, lacing=Longest)
