# Dynamo graph DWG_BatchExport.dyn "WIP_BlockSetoutExport" (Dynamo 2.0.3.8810)

string = StringInput("R:\Construction\01 Construction Projects\045 - Te Awa\03.3a Stage 3a\3.3a.2 Residential Drawings & Specs")  # graph input
directory_from_path = DirectoryObject(path=string)
string_2 = StringInput("*.rvt")  # graph input
boolean = BoolSelector(true)
getDirectoryContents = FileSystem.GetDirectoryContents(directory=directory_from_path, searchString=string_2, includeSubdirectories=boolean)
code_block = CodeBlock { "\\"; }
split = String.Split(str=getDirectoryContents.files, separater0=code_block, lacing=Longest)
lastItem = List.LastItem(list=split, lacing=Longest)

# group: GET & FILTER RVT FILES
code_block_2 = CodeBlock { "B_"; ""; }
replace = String.Replace(str=lastItem, searchFor=code_block_2.out0, replaceWith=code_block_2.out1)
code_block_3 = CodeBlock { ".rvt"; ""; }
replace_2 = String.Replace(str=replace, searchFor=code_block_3.out0, replaceWith=code_block_3.out1)
code_block_4 = CodeBlock { "045_B"; ""; }
replace_3 = String.Replace(str=replace_2, searchFor=code_block_4.out0, replaceWith=code_block_4.out1)
code_block_5 = CodeBlock { ["39","40","41","42"]; }
eq = replace_3 == code_block_5  # lacing=CrossProduct
anyTrue = Custom[List.AnyTrue](seq=eq)  # Returns true if any item in a list of booleans is true.
code_block_6 = CodeBlock { ["33","35","37","38","49","39","40","41","42","48","50"]; }

filterByBoolMask = List.FilterByBoolMask(list=getDirectoryContents.files, mask=anyTrue)

# group: FOLDER TO SAVE CAD
code_block_7 = CodeBlock { "\\"; }
indexOf = List.IndexOf(list=split, element=lastItem, lacing=Longest)
removeItemAtIndex = List.RemoveItemAtIndex(list=split, indices=indexOf, lacing=Longest)
join = String.Join(separator=code_block_7, string0=removeItemAtIndex)
flatten_list_and_replace_null = Custom[Flatten List and Replace Null with NULL VALUE](list=join)
filterByBoolMask_2 = List.FilterByBoolMask(list=flatten_list_and_replace_null, mask=anyTrue)

# group: CAD file name
filterByBoolMask_3 = List.FilterByBoolMask(list=lastItem, mask=anyTrue)
code_block_8 = CodeBlock { -4; 4; }
remove = String.Remove(str=filterByBoolMask_3.in, startIndex=code_block_8.out0, count=code_block_8.out1)
code_block_9 = CodeBlock { "_BlockSetout"; }
code_block_10 = CodeBlock(x=remove, y=code_block_9) { x+y; }

# group: EXPORTING
boolean_2 = BoolSelector(false)
openDocumentFile = Rhythm.Revit.Application.Applications.OpenDocumentFile(filePath=filterByBoolMask.in, audit=boolean_2, detachFromCentral=boolean_2)
view_to_export = CodeBlock { "001_BLOCK SITE SETOUT"; }
view_byname = Custom[View ByName](ViewName=view_to_export, docOrRevitLinkInstance=openDocumentFile)  # Collect views by given name in the active or given document. Based on a Christian Gartland's script.
boolean_3 = BoolSelector(true)
export_dwg_in_document = Custom[Export DWG in Document](docOrRevitLinkInstance=openDocumentFile, DirectoryPath=filterByBoolMask_2.in, view=view_byname, Filename=code_block_10, RunIt=boolean_3, lacing=Longest)  # Export views to DWG with export setup in the active or given document. Based on a script by Konrad K Sobon.
