# Dynamo graph RenameViewSheetName_BlockFileUnitNumbers.dyn (Dynamo 1.3.4.6666)

# group: 1) For Renaming Sheets
# note: This series of grouped nodes is for selecting sheet names to be renamed. You don't need to touch anything here, the names are for clarity.

# group: README FIRST
# note: Hi! This script is designed to tediously rename all the sheet and view names from their placeholder unit numbers (01, 02, 03, 04) to the actual villa numbers you specify (i.e. VL021, VL022 etc.). Please follow the instructions for this script grouped in orange as per this box (this script can really screw up your block file names if not!)
# PLEASE make sure to Reload Latest, and Synchronise Now before using this script. Don't touch anything inside the green boxes unless said in the instructions - the headings are labelled to help you understand what the script is doing at each stage.
# This script requires the following prequisites before use:
# archi-lab v2019.2.2
# If you have never installed a package before, contact either myself or James O Hagan!
# If you're stuck or unsure, feel free to pop over or flick me an email (joshua.joe@summerset.co.nz)
# Cheers!
# Josh

# group: 2) Sheet Name instructions
# note: Connect the following watch nodes (INPUT 01 & INPUT 02) to their respective other watch nodes labelled INPUT 01 & INPUT 02)

# group: 2) View Name instructions
# note: Connect the following watch nodes (INPUT 01 & INPUT 02) to their respective other watch nodes labelled INPUT 01 & INPUT 02)

# group: 1) For Renaming Views
# note: This series of grouped nodes is for selecting view names to be renamed. You don't need to touch anything here, the names are for clarity.

# group: 3) View/Sheet Names Find & Replace
# note: You only need to do this once - follow the notes below to replace the placeholder unit numbers with the actual villa numbers. It's super important to follow the exact naming so please follow it!

# group: Optional: Remove UNIT 03/04
# note: If you do not have a UNIT 04, you can use the script to remove them. See below:
# 1) Replace the "unit number" with " & 04" instead of " 04". Note the spaces before and after the &
# 2) Replace the "Villa Number" with " " (a blank space)
# 3) Follow the rest of the instructions to rename either sheets or views
# 4) After running the script completely, leave the rest of the script as it is, but come back down here, and replace " & 04" with " &"
# 5) Follow the rest of the instructions to rename
# 6) Profit!
# P.S. You can also use this process to remove UNIT 03 from your views

# group: 6) Run & Disconnect
# note: If you've checked all your names and they're okay, hit run after step 5. REMEMBER to disconnect any wires between "FINAL OUTPUT" and "INPUT 03/04" immediately after hitting run.
# If you are renaming views and sheets, repeat the process again as appropriate.
# If you are closing this file, remember not to save changes to this file either!

# group: Selects all 3D views, sections, plans and drafting views
element_types = ElementTypes("ViewPlan")
element_types_2 = ElementTypes("ViewSection")
element_types_3 = ElementTypes("View3D")
element_types_4 = ElementTypes("ViewDrafting")
create = List.Create(element_types, element_types_2, element_types_3, element_types_4)
all_elements_of_type = ElementsOfType(create)
flatten = Flatten(all_elements_of_type)

# group: Finds all the view names of the specified views
clear_list = Custom[Removes null/blank values](Input=flatten)  # This node will remove all Null and Empty Lists from any list.
string = StringInput("View Name")
gets_all_view_names = Element.GetParameterValueByName(element=clear_list, parameterName=string)
watch = Watch(gets_all_view_names)
setParameterByName = Element.SetParameterByName(element=clear_list, parameterName=string)  # unwired: value

# group: INPUT 01 & INPUT 02
connect_to_watch_node_input_01 = Watch(clear_list)
connect_to_watch_node_input_02 = Watch(watch)

# group: INPUT 01 & INPUT 02
input_01 = Watch(connect_to_watch_node_input_01)
input_02 = Watch(connect_to_watch_node_input_02)

# group: UNIT 01
unit_number = CodeBlock { " 01"; }
# note: PLEASE NOTE - in order to correctly rename placeholders, please add a space before the villa number below i.e.
# " VL041" instead of "VL041"
villa_number_to_replace_given = CodeBlock { " VL103"; }  # "Villa Number to replace given Unit Number"
replace = String.Replace(str=input_02, searchFor=unit_number, replaceWith=villa_number_to_replace_given)

# group: UNIT 02
unit_number_2 = CodeBlock { " 02"; }
# note: PLEASE NOTE - in order to correctly rename placeholders, please add a space before the villa number below i.e.
# " VL041" instead of "VL041"
villa_number_to_replace_given_2 = CodeBlock { " VL102"; }  # "Villa Number to replace given Unit Number"
replace_2 = String.Replace(str=replace, searchFor=unit_number_2, replaceWith=villa_number_to_replace_given_2)

# group: UNIT 03
unit_number_3 = CodeBlock { " 03"; }
# note: PLEASE NOTE - in order to correctly rename placeholders, please add a space before the villa number below i.e.
# " VL041" instead of "VL041"
villa_number_to_replace_given_3 = CodeBlock { " VL101"; }  # "Villa Number to replace given Unit Number"
replace_3 = String.Replace(str=replace_2, searchFor=unit_number_3, replaceWith=villa_number_to_replace_given_3)

# group: UNIT 04
unit_number_4 = CodeBlock { " & 04"; }
# note: PLEASE NOTE - in order to correctly rename placeholders, please add a space before the villa number below i.e.
# " VL041" instead of "VL041"
villa_number_to_replace_given_4 = CodeBlock { " "; }  # "Villa Number to replace given Unit Number"
replace_4 = String.Replace(str=replace_3, searchFor=unit_number_4, replaceWith=villa_number_to_replace_given_4)

# group: 4) CHECK NAMES FOR CORRECT RENAMING
# note: Make sure "FINAL OUTPUT" in Step 5 has no outgoing wires from its' output (>). Then hit run at the bottom. This shows all the view/sheet names renamed. CHECK THE NAMES FOR CORRECT NAMING BEFORE CONTINUING TO STEP 5
renamed_names = Watch(replace_4)

# group: 5) Actual renaming
# note: Connect the output (>) of this node to either input 03 for sheets, and input 04 for views
final_output = Watch(renamed_names)

input_03 = Watch(final_output)

# group: Sheet Renamer
# note: Connect the "renamed" names node to the value input here. Have fun! Note: you may have to run the script twice for all sheets to be renamed.
code_block = CodeBlock { "Sheet Name"; }
setParameterByName_2 = Element.SetParameterByName(element=input_01, parameterName=code_block, value=input_03)  # frozen
watch_2 = Watch(setParameterByName_2)

# group: Selects all sheets in project
categories = Categories("Sheets")
all_elements_of_category = ElementsOfCategory(categories)

# group: Sorts all the sheets by Sheet Number
string_2 = StringInput("Sheet Number")
getParameterValueByName = Element.GetParameterValueByName(element=all_elements_of_category, parameterName=string_2)
sortByKey = List.SortByKey(list=all_elements_of_category, keys=getParameterValueByName)

# group: Gets all the Sheet Names
code_block_2 = CodeBlock { "Sheet Name"; }
getParameterValueByName_2 = Element.GetParameterValueByName(element=sortByKey.sorted_list, parameterName=code_block_2)

# group: INPUT 01 & INPUT 02
connect_to_watch_node_input_01_2 = Watch(sortByKey.sorted_list)
connect_to_watch_node_input_02_2 = Watch(getParameterValueByName_2)

input_04 = Watch(final_output)

# group: View Renamer
code_block_3 = CodeBlock { "View Name"; }
# note: Connect the "renamed" names node to the value input here. Have fun! Note: you may have to run the script twice for all views to be renamed.
setParameterByName_3 = Element.SetParameterByName(element=input_01, parameterName=code_block_3, value=input_04)  # frozen
watch_3 = Watch(setParameterByName_3)
