# Dynamo graph VILLADeleteViews.dyn (Dynamo 2.0.3.8810)

categories = Categories(index=602)
all_elements_of_category = ElementsOfCategory(Category=categories)
clear_list = Custom[Clear List](input=all_elements_of_category)  # This node will remove all Null and Empty Lists from any list.
name = Element.Name(element=clear_list)
code_block = CodeBlock { "south"; }
boolean = BoolSelector(true)
contains = String.Contains(str=name, searchFor=code_block, ignoreCase=boolean)
filterByBoolMask = List.FilterByBoolMask(list=clear_list, mask=contains)
delete = archilab.Revit.Elements.Elements.Delete(element=filterByBoolMask.in)
